# Grasshopper definition 025_robot_artist_grasshopper.ghx (Grasshopper 1.0.7)
# plug-ins: COMPAS FAB

reload = Button()

# ----
# Robot
load = Button()
python = PythonScript(load=load)  # -> robot
# ---------- python: Python ----------
from scriptcontext import sticky as st

import compas

from compas_fab.robots.ur5 import Robot
from compas_ghpython.artists import RobotModelArtist

# Robot meshes are usually in meters
# Set a high percision to prevent parsing errors
# and configure Rhino itself in meters
compas.PRECISION = '12f'

# Store robot in component-based key
robot_key = 'robot_{}'.format(str(ghenv.Component.InstanceGuid))

if robot_key not in st:
    st[robot_key] = None

if load:
    robot = Robot(load_geometry=True)
    robot.artist = RobotModelArtist(robot.model)
    st[robot_key] = robot

robot = st[robot_key]
# ---------- end python ----------
robot = Data(python)

py = PythonScript(reload=reload)
# ---------- py: Python ----------
if reload:
    from compas_ghpython import unload_modules
    unload_modules('compas')
# ---------- end py ----------

# ---- group: forward kinematics
# Configuration
a1 = Slider(0, range=-360..360)
a2 = Slider(0, range=-360..360)
a3 = Slider(0, range=-360..360)
a4 = Slider(0, range=-360..360)
a5 = Slider(0, range=-360..360)
a6 = Slider(0, range=-360..360)
forward_kinematics = PythonScript(robot=robot, a1=a1, a2=a2, a3=a3, a4=a4, a5=a5, a6=a6)  # -> configuration
# ---------- forward_kinematics: Python ----------
import math
from compas_fab.robots import Configuration

if robot:
    configuration = [a1, a2, a3, a4, a5, a6]
    configuration = Configuration.from_revolute_values([math.radians(a) for a in configuration])
# ---------- end forward_kinematics ----------

# ----
# Visualisation
show_end_effector_frame = BooleanToggle(False)
show_base_frame = BooleanToggle(False)
show_collision = BooleanToggle(False)
show_frames = BooleanToggle(False)
show_visual = BooleanToggle(True)
robot_visualize = RobotVisualize(
    Robot=robot,
    Configuration=forward_kinematics,
    Show_visual=show_visual,
    Show_collision=show_collision,
    Show_frames=show_frames,
    Show_base_frame=show_base_frame,
    Show_end_effector_frame=show_end_effector_frame)  # -> Visual, Collision, Attached_meshes, Frames, Base_frame, Ee_frame
geo = Geometry(robot_visualize.Visual)
geo_2 = Geometry(robot_visualize.Collision)
draw = GhPythonScript(frames=robot_visualize.Frames, scale=Slider(0.1, range=0..1))  # -> P, V, C, W; inputs frames: list
# ---------- draw: Python ----------
from System.Drawing import Color
from compas_ghpython.utilities import draw_frame

red = Color.FromArgb(255, 0, 0)
green = Color.FromArgb(0, 255, 0)
blue = Color.FromArgb(0, 0, 255)

P = []
V = []
C = []

scale = float(scale)

for frame in frames:
    if not frame:
        continue
    plane = draw_frame(frame)
    P += [plane.Origin] * 3
    V.append(plane.XAxis * scale)
    V.append(plane.YAxis * scale)
    V.append(plane.ZAxis * scale)
    C += [red, green, blue]

W = 3
# ---------- end draw ----------
vdisex = VectorDisplayEx(Point=draw.P, Vector=draw.V, Colour=draw.C, Width=draw.W)
