# Grasshopper definition 07_robot_artist_grasshopper.ghx (Grasshopper 1.0.7)

reload = Button()

# ---- group: set config
# Configuration
a1 = Slider(-58, range=-360..360)
a2 = Slider(19, range=-360..360)
a3 = Slider(19, range=-360..360)
a4 = Slider(0, range=-360..360)
a5 = Slider(0, range=-360..360)
a6 = Slider(0, range=-360..360)
config = PythonScript(vals=[a1, a2, a3, a4, a5, a6])  # -> config; inputs vals: list
# ---------- config: Python ----------
import math
from compas_fab.robots import Configuration

config = Configuration.from_revolute_values([math.radians(a) for a in vals])
# revolute_values given from sliders - convert from degree to radians
# ---------- end config ----------

# ----
# Robot
load = Button()
python = PythonScript(load=load)  # -> model, artist
# ---------- python: Python ----------
from scriptcontext import sticky as st

import compas
import compas_fab

from compas.robots import LocalPackageMeshLoader
from compas.robots import RobotModel
from compas_ghpython.artists import RobotModelArtist

# Robot meshes are usually in meters
# Set a high percision to prevent parsing errors
# and configure Rhino itself in meters
compas.PRECISION = '12f'

# Store robot in component-based key
model_key = 'model_{}'.format(str(ghenv.Component.InstanceGuid))
artist_key = 'artist_{}'.format(str(ghenv.Component.InstanceGuid))

if model_key not in st:
    st[model_key] = None
if artist_key not in st:
    st[artist_key] = None

if load:
    loader = LocalPackageMeshLoader(compas_fab.get('universal_robot'), 'ur_description')
    model = RobotModel.from_urdf_file(loader.load_urdf('ur5.urdf'))
    model.load_geometry(loader)

    artist = RobotModelArtist(model)

    st[model_key] = model
    st[artist_key] = artist

model = st[model_key]
artist = st[artist_key]
# ---------- end python ----------
robotmodel = Data(python.model)

py = PythonScript(reload=reload)
# ---------- py: Python ----------
if reload:
    from compas_ghpython import unload_modules
    unload_modules('compas')
# ---------- end py ----------
python_2 = GhPythonScript(model=python.model, artist=python.artist)  # -> out, a; disabled
# ---------- python_2: Python ----------
from compas_fab.robots import Robot

robot = Robot(model, artist)
# ---------- end python_2 ----------

# ----
# Visualisation
# Missing Robot Visualize Component from lecture
visualize = GhPythonScript(model=robotmodel, artist=python.artist, config=config)  # -> out, a
# ---------- visualize: Python ----------
joint_names = [j.name for j in model.get_configurable_joints()]
config.joint_names = joint_names
artist.update(config.joint_dict)

a = artist.draw_visual()
# a = artist.draw_collision()
# ---------- end visualize ----------
