# Grasshopper definition 17_ik.ghx (Grasshopper 1.0.7)

reload = Button()

# ---- group: set config
# Configuration
a1 = Slider(0, range=-360..360)
a2 = Slider(0, range=-360..360)
a3 = Slider(0, range=-360..360)
a4 = Slider(0, range=-360..360)
a5 = Slider(0, range=-360..360)
a6 = Slider(0, range=-360..360)
config = PythonScript(vals=[a1, a2, a3, a4, a5, a6])  # -> config; inputs vals: list
# ---------- config: Python ----------
import math
from compas_fab.robots import Configuration

config = Configuration.from_revolute_values([math.radians(a) for a in vals])
# ---------- end config ----------

# ----
# Robot
load = Button()
python = PythonScript(load=load)  # -> model, artist
# ---------- python: Python ----------
from scriptcontext import sticky as st

import compas
import compas_fab

from compas.robots import LocalPackageMeshLoader
from compas.robots import RobotModel
from compas_ghpython.artists import RobotModelArtist

# Robot meshes are usually in meters
# Set a high percision to prevent parsing errors
# and configure Rhino itself in meters
compas.PRECISION = '12f'

# Store robot in component-based key
model_key = 'model_{}'.format(str(ghenv.Component.InstanceGuid))
artist_key = 'artist_{}'.format(str(ghenv.Component.InstanceGuid))

if model_key not in st:
    st[model_key] = None
if artist_key not in st:
    st[artist_key] = None

if load:
    loader = LocalPackageMeshLoader(compas_fab.get('universal_robot'), 'ur_description')
    model = RobotModel.from_urdf_file(loader.load_urdf('ur5.urdf'))
    model.load_geometry(loader)

    artist = RobotModelArtist(model)

    st[model_key] = model
    st[artist_key] = artist

model = st[model_key]
artist = st[artist_key]
# ---------- end python ----------
robotmodel = Data(python.model)

py = PythonScript(reload=reload)
# ---------- py: Python ----------
if reload:
    from compas_ghpython import unload_modules
    unload_modules('compas')
# ---------- end py ----------
i = Slider(0, range=0..10)
pt = Point(<point referenced from the Rhino model>)
xy = XYPlane(Origin=pt)
python_2 = GhPythonScript(robot=robotmodel, plane=xy, i=i)  # -> out, a; inputs i: Int32
# ---------- python_2: Python ----------
from compas_rhino.geometry import RhinoPlane
from compas_fab.robots import Configuration
from ur_kinematics import inverse_kinematics_ur5

f = RhinoPlane.from_geometry(plane).to_compas()
f.point /= 0.001

sols = inverse_kinematics_ur5(f)

a = Configuration.from_revolute_values(sols[i])

   # joint_names = model.get_configurable_joint_names()
   # joint_state = dict(zip(joint_names, joint_values))

# print sols[i]
# ---------- end python_2 ----------

# ----
# Visualisation
visualize = GhPythonScript(model=robotmodel, artist=python.artist, config=python_2.a)  # -> out, a
# ---------- visualize: Python ----------
joint_names = [j.name for j in model.get_configurable_joints()]
config.joint_names = joint_names
artist.update(config.joint_dict)
a = artist.draw_visual()
# ---------- end visualize ----------
