# Grasshopper definition assignment_03.ghx (Grasshopper 1.0.7)

connect = BooleanToggle(False)
load = BooleanToggle(False)
ros_connect = GhPythonScript(connect=connect)  # -> ros_client, is_connected
# ---------- ros_connect: Python ----------
import Grasshopper
import System
from ghpythonlib.componentbase import executingcomponent as component
from scriptcontext import sticky as st

from compas_fab.backends import RosClient
from compas_fab.ghpython.components import create_id


class ROSConnect(component):
    def SetUpParam(self, p, name, nickname, description):
        p.Name = name
        p.NickName = nickname
        p.Description = description
        p.Optional = True

    def RegisterInputParams(self, pManager):

        p = Grasshopper.Kernel.Parameters.Param_String()
        self.SetUpParam(p, "ip", "ip", "The ip address of ROS master. Defaults to 127.0.0.1")
        p.Access = Grasshopper.Kernel.GH_ParamAccess.item
        self.Params.Input.Add(p)

        p = Grasshopper.Kernel.Parameters.Param_Integer()
        self.SetUpParam(p, "port", "port", "The port of ROS master. Defaults to 9090.")
        p.Access = Grasshopper.Kernel.GH_ParamAccess.item
        self.Params.Input.Add(p)

        p = Grasshopper.Kernel.Parameters.Param_Boolean()
        self.SetUpParam(p, "connect", "connect", "If `True`, connect to ROS. If `False`, disconnect from ROS. Defaults to False.")
        p.Access = Grasshopper.Kernel.GH_ParamAccess.item
        self.Params.Input.Add(p)

    def RegisterOutputParams(self, pManager):
        p = Grasshopper.Kernel.Parameters.Param_GenericObject()
        self.SetUpParam(p, "ros_client", "ros_client", "The ROS client.")
        self.Params.Output.Add(p)

        p = Grasshopper.Kernel.Parameters.Param_Boolean()
        self.SetUpParam(p, "is_connected", "is_connected", "`True` if connection established.")
        self.Params.Output.Add(p)

    def SolveInstance(self, DA):
        p0 = self.marshal.GetInput(DA, 0)
        p1 = self.marshal.GetInput(DA, 1)
        p2 = self.marshal.GetInput(DA, 2)
        result = self.RunScript(p0, p1, p2)

        if result is not None:
            if not hasattr(result, '__getitem__'):
                self.marshal.SetOutput(result, DA, 0, True)
            else:
                self.marshal.SetOutput(result[0], DA, 0, True)
                self.marshal.SetOutput(result[1], DA, 1, True)

    def RunScript(self, ip, port, connect):
        ros_client = None

        ip = ip or '127.0.0.1'
        port = port or 9090

        key = create_id(self, 'ros_client')
        ros_client = st.get(key, None)

        if ros_client:
            st[key].close()
        if connect:
            st[key] = RosClient(ip, port)
            st[key].run(5)

        ros_client = st.get(key, None)
        is_connected = ros_client.is_connected if ros_client else False
        return (ros_client, is_connected)
# ---------- end ros_connect ----------
load_robot = GhPythonScript(ros_client=ros_connect.ros_client, load=load)  # -> robot
# ---------- load_robot: Python ----------
import Grasshopper
import System
from ghpythonlib.componentbase import executingcomponent as component
from scriptcontext import sticky as st

import compas
from compas_fab.ghpython.components import create_id
from compas_fab.ghpython.components.icons import ros_robot_icon
from compas_ghpython.artists import RobotModelArtist


class ROSRobot(component):
    def SetUpParam(self, p, name, nickname, description):
        p.Name = name
        p.NickName = nickname
        p.Description = description
        p.Optional = True

    def RegisterInputParams(self, pManager):
        p = Grasshopper.Kernel.Parameters.Param_GenericObject()
        self.SetUpParam(p, "ros_client", "ros_client", "The ROS client.")
        p.Access = Grasshopper.Kernel.GH_ParamAccess.item
        self.Params.Input.Add(p)

        p = Grasshopper.Kernel.Parameters.Param_Boolean()
        self.SetUpParam(p, "load", "load", "If `True`, loads the robot from ROS. Defaults to False.")
        p.Access = Grasshopper.Kernel.GH_ParamAccess.item
        self.Params.Input.Add(p)

    def RegisterOutputParams(self, pManager):
        p = Grasshopper.Kernel.Parameters.Param_GenericObject()
        self.SetUpParam(p, "robot", "robot", "The robot.")
        self.Params.Output.Add(p)

    def SolveInstance(self, DA):
        p0 = self.marshal.GetInput(DA, 0)
        p1 = self.marshal.GetInput(DA, 1)
        result = self.RunScript(p0, p1)

        if result is not None:
            self.marshal.SetOutput(result, DA, 0, True)

    def get_Internal_Icon_24x24(self):
        return ros_robot_icon

    def RunScript(self, ros_client, load):
        self.Message = "Loading..."
        compas.PRECISION = '12f'

        key = create_id(self, 'robot')

        if ros_client and ros_client.is_connected and load:
            # Load URDF from ROS
            robot = ros_client.load_robot(load_geometry=True)
            robot.artist = RobotModelArtist(robot.model)
            self.Message = "{} loaded".format(robot.name)
            st[key] = robot
        else:
            if st.get(key):
                self.Message = "{} loaded".format(st.get(key).name)
            else:
                self.Message = "No robot"

        robot = st.get(key, None)
        if robot:  # client sometimes need to be restarted, without needing to reload geometry
            robot.client = ros_client
        return robot
# ---------- end load_robot ----------

# ---- group: generate_planes
crv = Curve(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)
python = GhPythonScript(crv=crv)  # -> out, planes; inputs crv: Curve
# ---------- python: Python ----------
import Rhino.Geometry as rg
import math as m

def generate_planes(crv):
    params = crv.DivideByLength(0.1, True)
    pts = [crv.PointAt(p) for p in params]
    tans = [crv.TangentAt(p) for p in params]
    
    planes = []
    for pt, tan in zip(pts, tans):
        tan.Rotate(m.radians(90), rg.Vector3d.ZAxis)
        plane = rg.Plane(pt, tan, (-1)*rg.Vector3d.ZAxis)
        planes.append(plane)
    
    return planes

planes = generate_planes(crv)
# ---------- end python ----------

# ---- group: from_rhino_plane
# turn on and off again if no config error happen
pln = Plane(python.planes)
python_2 = GhPythonScript(robot=load_robot, plane=pln, run=Toggle(False))  # -> configurations; inputs plane: list of Plane, run: Boolean
# ---------- python_2: Python ----------
from compas_ghpython import unload_modules
unload_modules('assignment_03')
from compas_rhino.geometry import RhinoPlane
from assignment_03 import calculate_ik, store_configurations

configurations = []

if run:
    for p in plane:
        frame = RhinoPlane.from_geometry(p).to_compas()
        configuration = calculate_ik(robot, frame)
        configurations.append(configuration)
    store_configurations(configurations)
# ---------- end python_2 ----------
item = ListItem(List=python_2, Index=Slider(0, range=0..19), Wrap=True)

# ---- group: from_json
python_3 = GhPythonScript(robot=load_robot, run=Toggle(False))  # -> configurations; inputs run: Boolean
# ---------- python_3: Python ----------
from compas_ghpython import unload_modules
unload_modules('assignment_03')
from compas_rhino.geometry import RhinoPlane
from assignment_03 import calculate_ik, configuration_from_json


if run:
    configurations = configuration_from_json()
# ---------- end python_3 ----------
item_2 = ListItem(List=python_3, Index=Slider(0, range=0..19), Wrap=True)

# ----
visualize = GhPythonScript(robot=load_robot, configuration=item_2)  # -> visual, frames
# ---------- visualize: Python ----------
import Grasshopper
import System
from ghpythonlib.componentbase import executingcomponent as component

from compas.geometry import Frame
from compas.geometry import Transformation
from compas_ghpython.artists import MeshArtist
from compas_fab.ghpython.components.icons import robot_visualize_icon
from compas_ghpython import draw_frame

class RobotVisualize(component):
    def SetUpParam(self, p, name, nickname, description):
        p.Name = name
        p.NickName = nickname
        p.Description = description
        p.Optional = True

    def RegisterInputParams(self, pManager):
        p = Grasshopper.Kernel.Parameters.Param_GenericObject()
        self.SetUpParam(p, "robot", "robot", "The robot.")
        p.Access = Grasshopper.Kernel.GH_ParamAccess.item
        self.Params.Input.Add(p)

        p = Grasshopper.Kernel.Parameters.Param_String()
        self.SetUpParam(p, "group", "group", "The planning group used for end-effector and base visualization.")
        p.Access = Grasshopper.Kernel.GH_ParamAccess.item
        self.Params.Input.Add(p)

        p = Grasshopper.Kernel.Parameters.Param_GenericObject()
        self.SetUpParam(p, "configuration", "configuration", "The robot's full configuration.")
        p.Access = Grasshopper.Kernel.GH_ParamAccess.item
        self.Params.Input.Add(p)

    def RegisterOutputParams(self, pManager):

        p = Grasshopper.Kernel.Parameters.Param_GenericObject()
        self.SetUpParam(p, "visual", "visual", "The robot's visual meshes.")
        self.Params.Output.Add(p)

        p = Grasshopper.Kernel.Parameters.Param_GenericObject()
        self.SetUpParam(p, "frames", "frames", "The robot's joint frames.")
        self.Params.Output.Add(p)

    def SolveInstance(self, DA):
        p0 = self.marshal.GetInput(DA, 0)
        p1 = self.marshal.GetInput(DA, 1)
        p2 = self.marshal.GetInput(DA, 2)
        result = self.RunScript(p0, p1, p2)

        if result is not None:
            if not hasattr(result, '__getitem__'):
                self.marshal.SetOutput(result, DA, 0, True)
            else:
                self.marshal.SetOutput(result[0], DA, 0, True)
                self.marshal.SetOutput(result[1], DA, 1, True)

    def get_Internal_Icon_24x24(self):
        return robot_visualize_icon

    def RunScript(self, robot, group, configuration):

        visual = None
        frames = None

        if robot:
            configuration = configuration or robot.zero_configuration()

            robot.update(configuration, visual=True, collision=False)
            frames = [draw_frame(f) for f in robot.transformed_frames(configuration, group)]

            visual = robot.artist.draw_visual()

        return (visual, frames)
# ---------- end visualize ----------
