# Grasshopper definition 15_pick_and_place_cw.ghx (Grasshopper 1.0.7)

# ----
# Home
number_slider = Slider(0, range=-3.14..3.14)
home_config = GhPythonScript(j=[Slider(1.57, range=-3.14..3.14), Slider(-1.57, range=-3.14..3.14), Slider(1.57, range=-3.14..3.14), Slider(-1.57, range=-3.14..3.14), Slider(-1.57, range=-3.14..3.14), number_slider])  # -> config; inputs j: list
# ---------- home_config: Python ----------
from compas_fab.robots import Configuration

config = Configuration.from_revolute_values(j)
# ---------- end home_config ----------

# ----
# INPUT
# ROS
connect = BooleanToggle(False)
load_robot = BooleanToggle(True)
ros_connect = GhPythonScript(connect=connect)  # -> ros_client
# ---------- ros_connect: Python ----------
import Grasshopper
import System
from ghpythonlib.componentbase import executingcomponent as component
from scriptcontext import sticky as st

from compas_fab.backends import RosClient
from compas_fab.ghpython.components import create_id


class ROSConnect(component):
    def SetUpParam(self, p, name, nickname, description):
        p.Name = name
        p.NickName = nickname
        p.Description = description
        p.Optional = True

    def RegisterInputParams(self, pManager):

        p = Grasshopper.Kernel.Parameters.Param_String()
        self.SetUpParam(p, "ip", "ip", "The ip address of ROS master. Defaults to 127.0.0.1")
        p.Access = Grasshopper.Kernel.GH_ParamAccess.item
        self.Params.Input.Add(p)

        p = Grasshopper.Kernel.Parameters.Param_Integer()
        self.SetUpParam(p, "port", "port", "The port of ROS master. Defaults to 9090.")
        p.Access = Grasshopper.Kernel.GH_ParamAccess.item
        self.Params.Input.Add(p)

        p = Grasshopper.Kernel.Parameters.Param_Boolean()
        self.SetUpParam(p, "connect", "connect", "If `True`, connect to ROS. If `False`, disconnect from ROS. Defaults to False.")
        p.Access = Grasshopper.Kernel.GH_ParamAccess.item
        self.Params.Input.Add(p)

    def RegisterOutputParams(self, pManager):
        p = Grasshopper.Kernel.Parameters.Param_GenericObject()
        self.SetUpParam(p, "ros_client", "ros_client", "The ROS client.")
        self.Params.Output.Add(p)

    def SolveInstance(self, DA):
        p0 = self.marshal.GetInput(DA, 0)
        p1 = self.marshal.GetInput(DA, 1)
        p2 = self.marshal.GetInput(DA, 2)
        result = self.RunScript(p0, p1, p2)

        if result is not None:
            self.marshal.SetOutput(result, DA, 0, True)

    def RunScript(self, ip, port, connect):
        ros_client = None

        ip = ip or '127.0.0.1'
        port = port or 9090

        key = create_id(self, 'ros_client')
        ros_client = st.get(key, None)

        if ros_client:
            st[key].close()
        if connect:
            st[key] = RosClient(ip, port)
            st[key].run(5)

        ros_client = st.get(key, None)
        self.Message = 'Connected' if ros_client and ros_client.is_connected else 'Not connected'
        return ros_client
# ---------- end ros_connect ----------
load_robot_2 = GhPythonScript(ros_client=ros_connect, load=load_robot)  # -> robot
# ---------- load_robot_2: Python ----------
import Grasshopper
import System
from ghpythonlib.componentbase import executingcomponent as component
from scriptcontext import sticky as st

import compas
from compas_fab.ghpython.components import create_id
from compas_fab.ghpython.components.icons import ros_robot_icon
from compas_ghpython.artists import RobotModelArtist


class ROSRobot(component):
    def SetUpParam(self, p, name, nickname, description):
        p.Name = name
        p.NickName = nickname
        p.Description = description
        p.Optional = True

    def RegisterInputParams(self, pManager):
        p = Grasshopper.Kernel.Parameters.Param_GenericObject()
        self.SetUpParam(p, "ros_client", "ros_client", "The ROS client.")
        p.Access = Grasshopper.Kernel.GH_ParamAccess.item
        self.Params.Input.Add(p)

        p = Grasshopper.Kernel.Parameters.Param_Boolean()
        self.SetUpParam(p, "load", "load", "If `True`, loads the robot from ROS. Defaults to False.")
        p.Access = Grasshopper.Kernel.GH_ParamAccess.item
        self.Params.Input.Add(p)

    def RegisterOutputParams(self, pManager):
        p = Grasshopper.Kernel.Parameters.Param_GenericObject()
        self.SetUpParam(p, "robot", "robot", "The robot.")
        self.Params.Output.Add(p)

    def SolveInstance(self, DA):
        p0 = self.marshal.GetInput(DA, 0)
        p1 = self.marshal.GetInput(DA, 1)
        result = self.RunScript(p0, p1)

        if result is not None:
            self.marshal.SetOutput(result, DA, 0, True)

    def get_Internal_Icon_24x24(self):
        return ros_robot_icon

    def RunScript(self, ros_client, load):
        self.Message = "Loading..."
        compas.PRECISION = '12f'

        key = create_id(self, 'robot')

        if ros_client and ros_client.is_connected and load:
            # Load URDF from ROS
            robot = ros_client.load_robot(load_geometry=True)
            robot.artist = RobotModelArtist(robot.model)
            self.Message = "{} loaded".format(robot.name)
            st[key] = robot
        else:
            if st.get(key):
                self.Message = "{} loaded".format(st.get(key).name)
            else:
                self.Message = "No robot"

        robot = st.get(key, None)
        if robot:  # client sometimes need to be restarted, without needing to reload geometry
            robot.client = ros_client
        return robot
# ---------- end load_robot_2 ----------

# ----
# Approach offset
approach_offset = Slider(0.05, range=0..0.2)

# ----
# Tool
attach = BooleanToggle(True)
z_offset = Slider(0.07, range=-0.1..0.2)
attach_tool = GhPythonScript(robot=load_robot_2, attached=attach, z_offset=z_offset)  # -> tool_at_origin
# ---------- attach_tool: Python ----------
import os
from compas.geometry import Frame
from compas.datastructures import Mesh
from compas_fab.robots import PlanningScene
from compas_fab.robots import Tool
from compas_ghpython.artists import MeshArtist

HERE = os.path.dirname(ghenv.Component.OnPingDocument().FilePath)

# create tool from mesh and frame
mesh = Mesh.from_stl(os.path.join(HERE, 'vacuum_gripper.stl'))
frame = Frame([z_offset, 0, 0], [0, 0, 1], [0, 1, 0])
tool = Tool(mesh, frame, name='vacuum_gripper')
tool_at_origin = MeshArtist(mesh).draw()

if robot and robot.client and robot.client.is_connected:
    scene = PlanningScene(robot)
    if attached:
        robot.attach_tool(tool)
        scene.add_attached_tool()
    else:
        if robot.attached_tool:
            scene.remove_attached_tool()
            scene.remove_collision_mesh('attached_tool_link_collision_0')
            robot.detach_tool()
# ---------- end attach_tool ----------

# ----
# Element
number_slider_2 = Slider(0.012, range=0.01..0.05)
python = GhPythonScript(h=number_slider_2, w=Slider(0.016, range=0.01..0.05), d=Slider(0.031, range=0.01..0.05))  # -> brick, mesh
# ---------- python: Python ----------
from compas.geometry import Box
from compas.datastructures import Mesh
from compas_ghpython.artists import MeshArtist

brick = Box.from_width_height_depth(w, h, d)
brick = Mesh.from_shape(brick)

mesh = MeshArtist(brick).draw()
# ---------- end python ----------

# ----
# Toolbox
t0cf = T0CF(z_offset=0.07)
ik = GhPythonScript()  # -> configuration
# ---------- ik: Python ----------
import Grasshopper
import System
from ghpythonlib.componentbase import executingcomponent as component
from scriptcontext import sticky as st

from compas_fab.ghpython.components import coerce_frame
from compas_fab.backends import RosValidationError

class InverseKinematics(component):
    def SetUpParam(self, p, name, nickname, description):
        p.Name = name
        p.NickName = nickname
        p.Description = description
        p.Optional = True

    def RegisterInputParams(self, pManager):
        p = Grasshopper.Kernel.Parameters.Param_GenericObject()
        self.SetUpParam(p, "robot", "robot", "The robot.")
        p.Access = Grasshopper.Kernel.GH_ParamAccess.item
        self.Params.Input.Add(p)

        p = Grasshopper.Kernel.Parameters.Param_GenericObject()
        self.SetUpParam(p, "plane", "plane", "The plane or frame to calculate the inverse kinematic for.")
        p.Access = Grasshopper.Kernel.GH_ParamAccess.item
        self.Params.Input.Add(p)

        p = Grasshopper.Kernel.Parameters.Param_GenericObject()
        self.SetUpParam(p, "start_configuration", "start_configuration",
                        "If passed, the inverse will be calculated such that the calculated joint positions \
                         differ the least from the start_configuration. Defaults to the zero configuration.")
        p.Access = Grasshopper.Kernel.GH_ParamAccess.item
        self.Params.Input.Add(p)

        p = Grasshopper.Kernel.Parameters.Param_String()
        self.SetUpParam(p, "group", "group", "The planning group used for calculation. Defaults to the robot's main planning group.")
        p.Access = Grasshopper.Kernel.GH_ParamAccess.item
        self.Params.Input.Add(p)

    def RegisterOutputParams(self, pManager):
        p = Grasshopper.Kernel.Parameters.Param_GenericObject()
        self.SetUpParam(p, "a", "configuration", "The planning group's configuration.")
        self.Params.Output.Add(p)

    def SolveInstance(self, DA):
        p0 = self.marshal.GetInput(DA, 0)
        p1 = self.marshal.GetInput(DA, 1)
        p2 = self.marshal.GetInput(DA, 2)
        p3 = self.marshal.GetInput(DA, 3)
        result = self.RunScript(p0, p1, p2, p3)

        if result is not None:
            self.marshal.SetOutput(result, DA, 0, True)

    def get_Internal_Icon_24x24(self):
        return inverse_kinematics_icon

    def RunScript(self, robot, plane, start_configuration, group):
        configuration = None
        self.Message = ''
        if robot and robot.client and robot.client.is_connected and plane:
            frame = coerce_frame(plane)
            try:
                configuration = robot.inverse_kinematics(frame, start_configuration, group)
            except RosValidationError as e:
                self.Message = 'No solution found'
                raise
        
        if configuration:
            self.Message = 'Solution found'
        return configuration
# ---------- end ik ----------
plan_cartesian_motion = GhPythonScript()  # -> trajectory; inputs planes: list
# ---------- plan_cartesian_motion: Python ----------
import Grasshopper
import System
from ghpythonlib.componentbase import executingcomponent as component
from scriptcontext import sticky as st

from compas_fab.ghpython.components import create_id
from compas_fab.ghpython.components import coerce_frame
from compas_fab.ghpython.components.icons import plan_cartesian_motion_icon

class PlanCartesianMotion(component):
    def SetUpParam(self, p, name, nickname, description):
        p.Name = name
        p.NickName = nickname
        p.Description = description
        p.Optional = True

    def RegisterInputParams(self, pManager):
        p = Grasshopper.Kernel.Parameters.Param_GenericObject()
        self.SetUpParam(p, "robot", "robot", "The robot.")
        p.Access = Grasshopper.Kernel.GH_ParamAccess.item
        self.Params.Input.Add(p)

        p = Grasshopper.Kernel.Parameters.Param_GenericObject()
        self.SetUpParam(p, "planes", "planes", "The planes or frames through which the path is defined.")
        p.Access = Grasshopper.Kernel.GH_ParamAccess.list
        self.Params.Input.Add(p)

        p = Grasshopper.Kernel.Parameters.Param_GenericObject()
        self.SetUpParam(p, "start_configuration", "start_configuration",
                        "The robot's full configuration, i.e. values for all configurable joints of the entire robot, at the starting position. Defaults to the all-zero configuration.")  # noqa E501
        p.Access = Grasshopper.Kernel.GH_ParamAccess.item
        self.Params.Input.Add(p)

        p = Grasshopper.Kernel.Parameters.Param_String()
        self.SetUpParam(p, "group", "group", "The planning group used for calculation. Defaults to the robot's main planning group.")
        p.Access = Grasshopper.Kernel.GH_ParamAccess.item
        self.Params.Input.Add(p)

#        p = Grasshopper.Kernel.Parameters.Param_GenericObject()
#        self.SetUpParam(p, "attached_collision_meshes", "attached_collision_meshes", "A list of attached collision meshes to be included for planning.")
#        p.Access = Grasshopper.Kernel.GH_ParamAccess.list
#        self.Params.Input.Add(p)

#        p = Grasshopper.Kernel.Parameters.Param_GenericObject()
#        self.SetUpParam(p, "path_constraints", "path_constraints",
#                        "Optional constraints that can be imposed along the solution path. Note that path calculation won't work if the start_configuration violates these constraints. Defaults to None.")  # noqa E501
#        p.Access = Grasshopper.Kernel.GH_ParamAccess.list
#        self.Params.Input.Add(p)

        p = Grasshopper.Kernel.Parameters.Param_Number()
        self.SetUpParam(p, "max_step", "max_step", "The approximate distance between the calculated points. (Defined in the robot's units.) Defaults to 0.01.")
        p.Access = Grasshopper.Kernel.GH_ParamAccess.item
        self.Params.Input.Add(p)

        p = Grasshopper.Kernel.Parameters.Param_Boolean()
        self.SetUpParam(p, "compute", "compute", "If `True`, calculates a trajectory.")
        p.Access = Grasshopper.Kernel.GH_ParamAccess.item
        self.Params.Input.Add(p)

    def RegisterOutputParams(self, pManager):
        p = Grasshopper.Kernel.Parameters.Param_GenericObject()
        self.SetUpParam(p, "trajectory", "trajectory", "The calculated trajectory.")
        self.Params.Output.Add(p)

    def SolveInstance(self, DA):
        p0 = self.marshal.GetInput(DA, 0)
        p1 = self.marshal.GetInput(DA, 1)
        p2 = self.marshal.GetInput(DA, 2)
        p3 = self.marshal.GetInput(DA, 3)
        p4 = self.marshal.GetInput(DA, 4)
        p5 = self.marshal.GetInput(DA, 5)
#        p6 = self.marshal.GetInput(DA, 6)
#        p7 = self.marshal.GetInput(DA, 7)
#        result = self.RunScript(p0, p1, p2, p3, p4, p5, p6, p7)
        result = self.RunScript(p0, p1, p2, p3, p4, p5)

        if result is not None:
            self.marshal.SetOutput(result, DA, 0, True)

    def get_Internal_Icon_24x24(self):
        return plan_cartesian_motion_icon

    def RunScript(self, robot, planes, start_configuration, group, max_step, compute):

        key = create_id(self, 'trajectory')

        max_step = float(max_step) if max_step else 0.01
        # NOTE: Read from scene
        attached_collision_meshes = None
        path_constraints = None
        attached_collision_meshes = list(attached_collision_meshes) if attached_collision_meshes else None

        if robot and robot.client and robot.client.is_connected and start_configuration and planes and compute:
            frames = [coerce_frame(plane) for plane in planes]
            st[key] = robot.plan_cartesian_motion(frames,
                                                  start_configuration=start_configuration,
                                                  group=group,
                                                  options=dict(
                                                      max_step=max_step,
                                                      path_constraints=path_constraints,
                                                      attached_collision_meshes=attached_collision_meshes
                                                  ))

        trajectory = st.get(key, None)

        if trajectory and trajectory.fraction < 1.0:
            raise Exception('Incomplete trajectory. Fraction={}'.format(trajectory.fraction))

        return trajectory
# ---------- end plan_cartesian_motion ----------
visualize_trajectory = GhPythonScript()  # -> start_configuration, configurations, fraction, time, planes
# ---------- visualize_trajectory: Python ----------
import Grasshopper
import System
from ghpythonlib.componentbase import executingcomponent as component
from scriptcontext import sticky as st

from compas_ghpython import draw_frame
from compas_fab.ghpython.components import create_id
from compas_fab.ghpython.components import coerce_frame
from compas_fab.ghpython.components.icons import trajectory_visualize_icon

class TrajectoryVisualize(component):
    def SetUpParam(self, p, name, nickname, description):
        p.Name = name
        p.NickName = nickname
        p.Description = description
        p.Optional = True

    def RegisterInputParams(self, pManager):
        p = Grasshopper.Kernel.Parameters.Param_GenericObject()
        self.SetUpParam(p, "robot", "robot", "The robot.")
        p.Access = Grasshopper.Kernel.GH_ParamAccess.item
        self.Params.Input.Add(p)

        p = Grasshopper.Kernel.Parameters.Param_String()
        self.SetUpParam(p, "group", "group", "The planning group for which this trajectory was planned.")
        p.Access = Grasshopper.Kernel.GH_ParamAccess.item
        self.Params.Input.Add(p)

        p = Grasshopper.Kernel.Parameters.Param_GenericObject()
        self.SetUpParam(p, "trajectory", "trajectory", "The calculated trajectory.")
        p.Access = Grasshopper.Kernel.GH_ParamAccess.item
        self.Params.Input.Add(p)

    def RegisterOutputParams(self, pManager):
        p = Grasshopper.Kernel.Parameters.Param_GenericObject()
        self.SetUpParam(p, "start_configuration", "start_configuration", "The start configuration of the trajectory.")
        self.Params.Output.Add(p)

        p = Grasshopper.Kernel.Parameters.Param_GenericObject()
        self.SetUpParam(p, "configurations", "configurations", "The full configurations along the trajectory.")
        self.Params.Output.Add(p)

        p = Grasshopper.Kernel.Parameters.Param_Number()
        self.SetUpParam(p, "fraction", "fraction", "Indicates the percentage of requested trajectory that was calculated, e.g. 1 means the full trajectory was found.")
        self.Params.Output.Add(p)

        p = Grasshopper.Kernel.Parameters.Param_Number()
        self.SetUpParam(p, "time", "time", "The time which is needed to execute that trajectory at full speed.")
        self.Params.Output.Add(p)

        p = Grasshopper.Kernel.Parameters.Param_Plane()
        self.SetUpParam(p, "planes", "planes", "The planes of the robot's end-effector.")
        self.Params.Output.Add(p)

    def SolveInstance(self, DA):
        p0 = self.marshal.GetInput(DA, 0)
        p1 = self.marshal.GetInput(DA, 1)
        p2 = self.marshal.GetInput(DA, 2)
        result = self.RunScript(p0, p1, p2)

        if result is not None:
            if not hasattr(result, '__getitem__'):
                self.marshal.SetOutput(result, DA, 0, True)
            else:
                self.marshal.SetOutput(result[0], DA, 0, True)
                self.marshal.SetOutput(result[1], DA, 1, True)
                self.marshal.SetOutput(result[2], DA, 2, True)
                self.marshal.SetOutput(result[3], DA, 3, True)
                self.marshal.SetOutput(result[4], DA, 4, True)

    def get_Internal_Icon_24x24(self):
        return trajectory_visualize_icon

    def RunScript(self, robot, group, trajectory):
        start_configuration = None
        configurations = []
        fraction = 0.
        time = 0.

        planes = []
        positions = []
        velocities = []
        accelerations = []

        if robot and trajectory:
            group = group or robot.main_group_name

            for c in trajectory.points:
                configurations.append(robot.merge_group_with_full_configuration(c, trajectory.start_configuration, group))
                frame = robot.forward_kinematics(c, group, options=dict(solver='model'))
                planes.append(draw_frame(frame))
                positions.append(c.positions)
                velocities.append(c.velocities)
                accelerations.append(c.accelerations)

            start_configuration = trajectory.start_configuration
            fraction = trajectory.fraction
            time = trajectory.time_from_start

        # return outputs if you have them; here I try it for you:
        return (start_configuration, configurations, fraction, time, planes)
# ---------- end visualize_trajectory ----------

# ----
# Static objects
mesh = Mesh(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)
python_2 = GhPythonScript(robot=load_robot_2, meshes=mesh)  # inputs meshes: list
# ---------- python_2: Python ----------
import os
from compas.geometry import Frame
from compas.datastructures import Mesh
from compas_fab.robots import PlanningScene
from compas_fab.robots import CollisionMesh
from compas_ghpython.artists import MeshArtist
from compas_rhino.geometry import RhinoMesh

if robot and robot.client and robot.client.is_connected:
    static_cm_name = 'static_objects'
    scene = PlanningScene(robot)
    scene.remove_collision_mesh(static_cm_name)
    if meshes:
        for mesh in meshes:
            mesh = RhinoMesh.from_geometry(mesh).to_compas()
            cm = CollisionMesh(mesh, static_cm_name)
            scene.append_collision_mesh(cm)
# ---------- end python_2 ----------

# ----
# Place
crv = Curve(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)
divide = DivideCurve(Curve=crv, Count=25, Kinks=False)  # -> Points, Tangents, Parameters
t0cf_2 = T0CF(tcf_frame=divide.Points, z_offset=z_offset)

# ----
# Pick
pt = Point(Point(-0.06516250879, 0.5938601462, 0.09412387155))
t0cf_3 = T0CF(tcf_frame=pt, z_offset=z_offset)

# ----
# Cartesian pickup plan
# TODO: cartesian pickup
pickup_frames = GhPythonScript(pick_t0cf_frame=t0cf_3, approach_offset=approach_offset)  # -> pickup_t0cf_frames
# ---------- pickup_frames: Python ----------
from compas.geometry import Translation
from compas_fab.ghpython.components import coerce_frame

# TODO: create a list of pickup frames with 3 frames:
# approach frame + pick up frame + approach frame
f = coerce_frame(pick_t0cf_frame)

approach_frame = f.copy()
approach_frame.transform(Translation.from_vector([0, 0, approach_offset]))


pickup_t0cf_frames = [approach_frame, f, approach_frame]
# ---------- end pickup_frames ----------
# SOLVE
plan_cartesian_motion_2 = GhPythonScript(robot=load_robot_2, planes=pickup_frames, start_configuration=home_config, compute=Button())  # -> trajectory; inputs planes: list; same code as plan_cartesian_motion
visualize_trajectory_2 = GhPythonScript(robot=load_robot_2, trajectory=plan_cartesian_motion_2)  # -> start_configuration, configurations, fraction, time, planes; same code as visualize_trajectory

# ----
# Placement plan
number_slider_3 = Slider(7, range=0..100)
prepare_scene = GhPythonScript(robot=load_robot_2, i=number_slider_3, place_t0cf_frames=t0cf_2, element=python.brick, approach_offset=approach_offset)  # -> approach_t0cf_frame, place_t0cf_frame; inputs i: Int32, place_t0cf_frames: list
# ---------- prepare_scene: Python ----------
import math
from compas.geometry import Frame
from compas.geometry import Transformation
from compas.geometry import Translation
from compas_fab.robots import PlanningScene
from compas_fab.robots import AttachedCollisionMesh
from compas_fab.robots import CollisionMesh
from compas_fab.ghpython.components import coerce_frame


# TODO: Calculate placement and approach frames
# and prepare scene collision meshes
place_tolerance = 0.002
place_t0cf_frames = [coerce_frame(f) for f in place_t0cf_frames]

#approach_t0cf_frames = []
#place_t0cf_framess = []

#for i in range (10):

place_t0cf_frame = place_t0cf_frames[i]
place_t0cf_frame = place_t0cf_frame.transformed(Translation.from_vector([0, 0, 0.006 + place_tolerance]))
approach_t0cf_frame = place_t0cf_frame.transformed(Translation.from_vector([0, 0, approach_offset]))

#    approach_t0cf_frames.append(approach_t0cf_frame)
#    place_t0cf_framess.append(place_t0cf_frame)

if robot:
    scene = PlanningScene(robot)
    # preparing current brick
    scene.remove_attached_collision_mesh('brick')
    scene.remove_collision_mesh('brick')
    ee_link_name = robot.get_end_effector_link_name()
    if robot.attached_tool:
        brick_frame = robot.attached_tool.frame.copy()
    else:
        brick_frame = Frame.worldXY()
    brick_frame.point.x += 0.006
    brick_acm = AttachedCollisionMesh(CollisionMesh(element, 'brick', brick_frame), ee_link_name)
    scene.add_attached_collision_mesh(brick_acm)
    # prepare prev elements
    built_elements = 'built_elements'
    scene.remove_collision_mesh(built_elements)
    for f in robot.from_t0cf_to_tcf(place_t0cf_frames[0:i]):
        t = Transformation.from_frame(f)
        mesh = element.transformed(t)
        cm = CollisionMesh(mesh, built_elements)
        scene.append_collision_mesh(cm)
# ---------- end prepare_scene ----------
plan_motion = GhPythonScript(
    robot=load_robot_2,
    home_config=home_config,
    approach_t0cf_frame=prepare_scene.approach_t0cf_frame,
    place_t0cf_frame=prepare_scene.place_t0cf_frame,
    compute=Button())  # -> trajectory, place_trajectory
# ---------- plan_motion: Python ----------
import math
from compas.geometry import Frame
from compas.geometry import Transformation
from compas.geometry import Translation
from compas_ghpython.artists import MeshArtist
from compas_fab.robots import Configuration
from compas_fab.robots import PlanningScene
from compas_fab.robots import AttachedCollisionMesh
from compas_fab.robots import CollisionMesh
from compas_fab.ghpython.components import coerce_frame
from scriptcontext import sticky as st

# TODO: Calculate two trajectories: 
# 1) kinematic plan from last point of pickup 
# 2) cartesian plan for placing


traj_key = '{}_{}'.format('trajectory', ghenv.Component.InstanceGuid)
place_key = '{}_{}'.format('place_trajectory', ghenv.Component.InstanceGuid)



place_t0cf_frame = coerce_frame(place_t0cf_frame)
approach_t0cf_frame = coerce_frame(approach_t0cf_frame)
if robot and compute:
    start_configuration = robot.zero_configuration()
    if pickup_trajectory:
        start_configuration.values = pickup_trajectory.points[-1].values
    tolerance_position = 0.001
    tolerance_axes = [math.radians(1)] * 3
    # create goal constraints from frame
    goal_constraints = robot.constraints_from_frame(approach_t0cf_frame,
                                                    tolerance_position,
                                                    tolerance_axes,
                                                    group)
    trajectory = robot.plan_motion(goal_constraints,
                                   start_configuration,
                                   group
                                   ,
                                   options=dict(planner_id='RRTstarkConfigDefault'))
    frames = [approach_t0cf_frame, place_t0cf_frame]
    start_configuration = robot.zero_configuration()
    start_configuration.values = trajectory.points[-1].values
    place_trajectory = robot.plan_cartesian_motion(frames,
                                                    start_configuration,
                                                    group=group,
                                                    options=dict(
                                                        max_step=0.01,
                                                        avoid_collisions=True,
                                                    ))
    st[traj_key] = trajectory
    st[place_key] = place_trajectory
trajectory = st.get(traj_key)
place_trajectory = st.get(place_key)
# ---------- end plan_motion ----------
merge_trajectories = GhPythonScript(pick=plan_cartesian_motion_2, move=plan_motion.trajectory, place=plan_motion.place_trajectory)  # -> configurations, trajectories
# ---------- merge_trajectories: Python ----------
# TODO: Merge all trajectories

configurations = pick.points + move.points + place.points

trajectories = []

trajectories.append(pick)
trajectories.append(move)
trajectories.append(place)


print trajectories
# ---------- end merge_trajectories ----------

visualize_trajectory_3 = GhPythonScript(robot=load_robot_2, trajectory=plan_motion.trajectory)  # -> start_configuration, configurations, fraction, time, planes; same code as visualize_trajectory
visualize_trajectory_4 = GhPythonScript(robot=load_robot_2, trajectory=plan_motion.place_trajectory)  # -> start_configuration, configurations, fraction, time, planes; same code as visualize_trajectory
item = ListItem(List=merge_trajectories.configurations, Index=Slider(72, range=0..100), Wrap=True)

# ----
# Visualization
reload = BooleanToggle(True)
# OUTPUT
visualize = GhPythonScript(robot=load_robot_2, configuration=item, reload_scene=reload)  # -> visual, frames, attached_collision_meshes, collision_meshes
# ---------- visualize: Python ----------
import Grasshopper
import System
from ghpythonlib.componentbase import executingcomponent as component
from scriptcontext import sticky as st

from compas.geometry import Frame
from compas.geometry import Transformation
from compas_ghpython.artists import MeshArtist
from compas_ghpython import draw_frame
from compas_fab.ghpython.components import create_id
from compas_fab.ghpython.components.icons import robot_visualize_icon

class RobotVisualize(component):
    def SetUpParam(self, p, name, nickname, description):
        p.Name = name
        p.NickName = nickname
        p.Description = description
        p.Optional = True

    def RegisterInputParams(self, pManager):
        p = Grasshopper.Kernel.Parameters.Param_GenericObject()
        self.SetUpParam(p, "robot", "robot", "The robot.")
        p.Access = Grasshopper.Kernel.GH_ParamAccess.item
        self.Params.Input.Add(p)

        p = Grasshopper.Kernel.Parameters.Param_String()
        self.SetUpParam(p, "group", "group", "The planning group used for end-effector and base visualization.")
        p.Access = Grasshopper.Kernel.GH_ParamAccess.item
        self.Params.Input.Add(p)

        p = Grasshopper.Kernel.Parameters.Param_GenericObject()
        self.SetUpParam(p, "configuration", "configuration", "The robot's full configuration.")
        p.Access = Grasshopper.Kernel.GH_ParamAccess.item
        self.Params.Input.Add(p)

        p = Grasshopper.Kernel.Parameters.Param_Boolean()
        self.SetUpParam(p, "reload_scene", "reload_scene", "Whether or not to reload the scene information from the client.")
        p.Access = Grasshopper.Kernel.GH_ParamAccess.item
        self.Params.Input.Add(p)

    def RegisterOutputParams(self, pManager):

        p = Grasshopper.Kernel.Parameters.Param_GenericObject()
        self.SetUpParam(p, "visual", "visual", "The robot's visual meshes.")
        self.Params.Output.Add(p)

        p = Grasshopper.Kernel.Parameters.Param_GenericObject()
        self.SetUpParam(p, "frames", "frames", "The robot's joint frames.")
        self.Params.Output.Add(p)

        p = Grasshopper.Kernel.Parameters.Param_GenericObject()
        self.SetUpParam(p, "attached_collision_meshes", "attached_collision_meshes", "Attached collision meshes in the scene.")
        self.Params.Output.Add(p)

        p = Grasshopper.Kernel.Parameters.Param_GenericObject()
        self.SetUpParam(p, "collision_meshes", "collision_meshes", "Collision meshes in the scene.")
        self.Params.Output.Add(p)

    def SolveInstance(self, DA):
        p0 = self.marshal.GetInput(DA, 0)
        p1 = self.marshal.GetInput(DA, 1)
        p2 = self.marshal.GetInput(DA, 2)
        p3 = self.marshal.GetInput(DA, 3)
        result = self.RunScript(p0, p1, p2, p3)

        if result is not None:
            if not hasattr(result, '__getitem__'):
                self.marshal.SetOutput(result, DA, 0, True)
            else:
                self.marshal.SetOutput(result[0], DA, 0, True)
                self.marshal.SetOutput(result[1], DA, 1, True)
                self.marshal.SetOutput(result[2], DA, 2, True)
                self.marshal.SetOutput(result[3], DA, 3, True)

    def get_Internal_Icon_24x24(self):
        return robot_visualize_icon

    def RunScript(self, robot, group, configuration, reload_scene):

        visual = None
        frames = None
        collision_meshes = []
        attached_collision_meshes = []

        if robot:
            configuration = configuration or robot.zero_configuration()

            robot.update(configuration, visual=True, collision=False)
            frames = [draw_frame(f) for f in robot.transformed_frames(configuration, group)]

            visual = robot.artist.draw_visual()
            
        scene_key = create_id(self, 'scene')
        
        if robot and (reload_scene or scene_key not in st):
            st[scene_key] = robot.client.get_planning_scene()
        
        scene = st.get(scene_key, None)

        if scene and robot and robot.client and robot.client.is_connected:
            
            scene_key_co = scene_key + '_co'
            if reload_scene or scene_key_co not in st:
                for co in scene.world.collision_objects:
                    # HACK: Little workaround to a bug in to_collision_meshes()
                    header = co.header
                    frame_id = header.frame_id
                    co.header = dict(frame_id=frame_id)
                    cms = co.to_collision_meshes()
                    # HACK: Restore proper header
                    co.header = header
                
                    for cm in cms:
                        if frame_id != '/world':
                            raise NotImplementedException('Only world-referenced collision meshes are supported')
                
                        if cm.frame != Frame.worldXY():
                            t = Transformation.from_frame(cm.frame)
                            mesh = cm.mesh.transformed(t)
                        else:
                            mesh = cm.mesh
                
                        rhino_mesh = MeshArtist(mesh).draw()
                        collision_meshes.append(rhino_mesh)
                st[scene_key_co] = collision_meshes

            collision_meshes = st.get(scene_key_co, None)
            
            for aco in scene.robot_state.attached_collision_objects:
                for acm in aco.to_attached_collision_meshes():
                    frame_id = aco.object['header']['frame_id']
                    frame = robot.forward_kinematics(configuration, options=dict(link=frame_id))
                    t = Transformation.from_frame(frame)

                    # Local CM frame
                    if acm.collision_mesh.frame and acm.collision_mesh.frame != Frame.worldXY():
                        t = t * Transformation.from_frame(acm.collision_mesh.frame)

                    mesh = acm.collision_mesh.mesh.transformed(t)
            
                    rhino_mesh = MeshArtist(mesh).draw()
                    attached_collision_meshes.append(rhino_mesh)

        return (visual, frames, attached_collision_meshes, collision_meshes)
# ---------- end visualize ----------

_1 = Data([null x3])
_1_2 = Data([null x3])
_1_3 = Data([null x3])
_1_4 = Data([null x3])
_1_5 = Data([null x3])
_1_6 = Data([null x3])
_1_7 = Data([null x3])
_1_8 = Data([null x3])
py = PythonScript()  # -> path
# ---------- py: Python ----------
import sys
import os

ghComp = ghenv.Component
ghDoc = ghComp.OnPingDocument()

# the full path of the gh file
path = ghDoc.FilePath
# the current directory 
path = os.path.abspath(os.path.join(path, ".."))

print path
# ---------- end py ----------
py_2 = PythonScript()  # -> path; same code as py
python_3 = GhPythonScript(configurations=merge_trajectories.configurations, path=py)  # -> out, a; inputs configurations: list
# ---------- python_3: Python ----------
import compas

compas.json_dump(configurations, path + '\data.json')
# ---------- end python_3 ----------
python_4 = GhPythonScript(trajectories=[_1_2, _1, _1_8, _1_6, _1_3, _1_7, _1_4, _1_5], path=py_2)  # -> out, a; inputs trajectories: list
# ---------- python_4: Python ----------
import compas

compas.json_dump(trajectories, path + '\data_traj.json')
# ---------- end python_4 ----------

# ==== cluster T0CF
tcf_frame = ClusterInput()
z_offset = ClusterInput()
pln = Plane(tcf_frame)
num = Number(z_offset)

# ----
# Adjust to UR5 frame
xz = XZPlane(Origin=pln)
prot = RotatePlane(Plane=xz, Angle=-1.57)

vec = VectorXYZ(XComponent=0, YComponent=0, ZComponent=num)  # -> Vector, Length
move = Move(Geometry=prot, Motion=vec.Vector)  # -> Geometry, Transform
pln_2 = Plane(move.Geometry)
t0cf_frame = ClusterOutput(pln_2)
