# Grasshopper definition 03_assemblies.ghx (Grasshopper 1.0.7)

# ----
# Pick
number_slider = Slider(0.07, range=0..0.1)
pt = Point(Point(-0.06432690563, 0.6685124513, 0.08173572512))
t0cf = T0CF(tcf_frame=pt, z_offset=number_slider)

# ----
# Approach offset
approach_offset = Slider(0.05, range=0..0.2)

# ----
# Element
number_slider_2 = Slider(0.012, range=0.01..0.05)
python = GhPythonScript(h=number_slider_2, w=Slider(0.031, range=0.01..0.05), d=Slider(0.016, range=0.01..0.05))  # -> shape, brick, mesh
# ---------- python: Python ----------
from compas.geometry import Box
from compas.datastructures import Mesh
from compas_ghpython.artists import MeshArtist

shape = Box.from_width_height_depth(w, h, d)
brick = Mesh.from_shape(shape)

mesh = MeshArtist(brick).draw()
# ---------- end python ----------

# ----
# Static objects
mesh = Mesh(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)
python_2 = GhPythonScript(meshes=mesh)  # inputs meshes: list
# ---------- python_2: Python ----------
import os
from compas.geometry import Frame
from compas.datastructures import Mesh
from compas_fab.robots import PlanningScene
from compas_fab.robots import CollisionMesh
from compas_ghpython.artists import MeshArtist
from compas_rhino.geometry import RhinoMesh

if robot and robot.client and robot.client.is_connected:
    static_cm_name = 'static_objects'
    scene = PlanningScene(robot)
    scene.remove_collision_mesh(static_cm_name)
    if meshes:
        for mesh in meshes:
            mesh = RhinoMesh.from_geometry(mesh).to_compas()
            cm = CollisionMesh(mesh, static_cm_name)
            scene.append_collision_mesh(cm)
# ---------- end python_2 ----------

# ----
# Example assemblies
pt_2 = Point(Point(0.3265536804, -0.1109182647, 0))
pt_3 = Point(Point(0.2157134479, 0.001329246688, 0))
pt_4 = Point(Point(0.4439170338, 0.09527581449, 0))
pt_5 = Point(Point(0.3236795852, 0.1949461524, 0))
shape = Data(python.shape)
number_slider_3 = Slider(0.0005, range=0..0.001)
num_bricks_per_row = Slider(9, range=0..100)
pt_6 = Point([pt_2, pt_3, pt_4, pt_5])
python_3 = GhPythonScript(points=pt_6, shape=shape, num_rows=Slider(9, range=0..10), tolerance_height=number_slider_3)  # -> curves; inputs points: list, num_rows: Int32
# ---------- python_3: Python ----------
import Rhino.Geometry as rg
from compas.geometry import project_points_line

height = shape.zsize

ptS, ptA, ptB, ptE = points
line = ptS, ptE
ptAj, ptBj = project_points_line([ptA, ptB], line)
ptAj, ptBj = rg.Point3d(*ptAj), rg.Point3d(*ptBj)
stepA = (ptAj - ptA)/(num_rows - 1)
stepB = (ptBj - ptB)/(num_rows - 1)
up = rg.Vector3d(0, 0, height + tolerance_height)

curves = []
for i, r in enumerate(range(num_rows)):
    crv = rg.Curve.CreateControlPointCurve(points, 3)
    curves.append(crv)
    points = [p + up for p in points]
    points[1] += stepA
    points[2] += stepB
# ---------- end python_3 ----------
python_4 = GhPythonScript(curves=python_3, num_bricks=num_bricks_per_row, shape=shape)  # -> assembly; inputs curves: list, num_bricks: Int32
# ---------- python_4: Python ----------
from compas.datastructures import Mesh
from compas.geometry import Translation
from compas.geometry import Vector
from compas.geometry import Frame

import os
import sys
HERE = os.path.dirname(ghenv.Component.OnPingDocument().FilePath)
if HERE not in sys.path: sys.path.append(HERE)

## Start assembly definition
from assembly import Assembly
from assembly import Element

assembly = Assembly()
assembly.attributes['element'] = shape

key = 0

for k, crv in enumerate(curves):
    length = crv.GetLength()
    if k % 2 == 0:
        ts = crv.LengthParameter(shape.width/2)[1]
        te = crv.LengthParameter(length - shape.width/2)[1]
        params = crv.Trim(ts, te).DivideByCount(num_bricks - 1, True)
    else:
        params = crv.DivideByCount(num_bricks, True)
        params[0] = crv.LengthParameter(shape.depth/2)[1]
        params[-1] = crv.LengthParameter(length - shape.depth/2)[1]

    for j, t in enumerate(params):
        x, y, z = 0, 0, (shape.height / 2)
        point = crv.PointAt(t)
        tangent = crv.TangentAt(t)
        yaxis = Vector(0,0,1).cross(tangent)
        
        if k % 2 == 1 and j in [0, len(params) - 1]:
            frame = Frame(point, yaxis, -tangent)
        else:
            frame = Frame(point, tangent, yaxis)

        frame = frame.transformed(Translation.from_vector([x, y, z]))
        element = Element(frame=frame, geometry_at_origin=Mesh.from_shape(shape))
        assembly.add_element(element, key)
        key += 1
# ---------- end python_4 ----------

pt_7 = Point(Point(0.320019137, -0.2407715452, 0))
shape_2 = Data(python.shape)
python_5 = GhPythonScript(
    point=pt_7,
    shape=shape_2,
    num_rows=Slider(9, range=0..10),
    tolerance_height=number_slider_3,
    offset=Slider(0.002, range=0..0.01))  # -> assembly; inputs num_rows: Int32
# ---------- python_5: Python ----------
from compas.datastructures import Mesh
from compas.geometry import Translation
from compas.geometry import Vector
from compas.geometry import Point
from compas.geometry import Frame
import Rhino.Geometry as rg

import os
import sys
HERE = os.path.dirname(ghenv.Component.OnPingDocument().FilePath)
if HERE not in sys.path: sys.path.append(HERE)

## Start assembly definition
from assembly import Assembly
from assembly import Element

assembly = Assembly()
assembly.attributes['element'] = shape

key = 0

for row in range(num_rows):
    
    x, y, z = 0, 0, (shape.height / 2)
    
    p = Point(*list(point))
    p.z = row * (shape.height + tolerance_height)
    
    if row % 2 == 0:
        v = Vector(1, 0, 0)
        xaxis = Vector(0, 1, 0)
        yaxis = Vector(-1, 0, 0)
    else:
        v = Vector(0, 1, 0)
        xaxis = Vector(1, 0, 0)
        yaxis = Vector(0, 1, 0)
        
    pointA = p - v * (shape.depth/2 + offset)
    pointB = p + v * (shape.depth/2 + offset)
    frameA = Frame(pointA, xaxis, yaxis)
    frameB = Frame(pointB, xaxis, yaxis)
    
    for frame in [frameA, frameB]:
        frame = frame.transformed(Translation.from_vector([x, y, z]))
        element = Element(frame=frame, geometry_at_origin=Mesh.from_shape(shape))
        assembly.add_element(element, key)
        key += 1
# ---------- end python_5 ----------

python_6 = GhPythonScript(assembly=python_5)  # -> elements
# ---------- python_6: Python ----------
from compas_fab.robots import JointTrajectory
from compas_ghpython.artists import MeshArtist
#from helpers import traversal_buildup_sequence
#from helpers import traversal_breadth_first_ordering
from helpers import traversal_linearly_ordered



elements = []
for j, n in enumerate(traversal_linearly_ordered(assembly)):
    print j
    geom = assembly.element(n).geometry_at_placement
    mesh = MeshArtist(geom).draw()
    elements.append(mesh)
# ---------- end python_6 ----------
python_7 = GhPythonScript(assembly=python_4)  # -> elements; same code as python_6

# ==== cluster T0CF
tcf_frame = ClusterInput()
z_offset = ClusterInput()
pln = Plane(tcf_frame)
num = Number(z_offset)

# ----
# Adjust to UR5 frame
xz = XZPlane(Origin=pln)
prot = RotatePlane(Plane=xz, Angle=-1.57)

vec = VectorXYZ(XComponent=0, YComponent=0, ZComponent=num)  # -> Vector, Length
move = Move(Geometry=prot, Motion=vec.Vector)  # -> Geometry, Transform
pln_2 = Plane(move.Geometry)
t0cf_frame = ClusterOutput(pln_2)
