# Grasshopper definition 04_tool.ghx (Grasshopper 1.0.7)

ros = ROSConnect(ip="ros-vzby-dzht.yaler.io", port=80, connect=Toggle(False))  # -> ros_client, is_connected; inputs port: Int32, connect: Boolean
#   port ip: The ip address ROS. Defaults to 127.0.0.1.
#   port port: The port of ROS. Defaults to 9090.
#   port connect: If True, connects to ROS. If False, disconnects from ROS. Defaults to False.
#   port ros_client: The ROS client.
#   port is_connected: True if connection established.
# ---------- ros: Python ----------
"""
Connect or disconnect to ROS.

COMPAS FAB v0.18.0
"""
from ghpythonlib.componentbase import executingcomponent as component
from scriptcontext import sticky as st

from compas_fab.backends import RosClient
from compas_fab.ghpython.components import create_id


class ROSConnect(component):
    def RunScript(self, ip, port, connect):
        ros_client = None

        ip = ip or '127.0.0.1'
        port = port or 9090

        key = create_id(self, 'ros_client')
        ros_client = st.get(key, None)

        if ros_client:
            st[key].close()
        if connect:
            st[key] = RosClient(ip, port)
            st[key].run(5)

        ros_client = st.get(key, None)
        is_connected = ros_client.is_connected if ros_client else False
        return (ros_client, is_connected)
# ---------- end ros ----------
subscribe = GhPythonScript(
    ros_client=ros.ros_client,
    topic_name="/joint_states",
    topic_type="sensor_msgs/JointState",
    start=Button(),
    stop=Button())  # -> topic, last_msg, is_subscribed
# ---------- subscribe: Python ----------
import Grasshopper
from ghpythonlib.componentbase import executingcomponent as component
from scriptcontext import sticky as st
import time
from roslibpy import Topic
from compas_fab.ghpython.components import create_id
from compas_fab.backends.ros import ROSmsg
import time

class ROSTopicSubscribe(component):
    def RunScript(self, ros_client, topic_name, topic_type, interval, start, stop):
        if not topic_name:
            raise ValueError('Please specify the name of the topic')
        if not topic_type:
            raise ValueError('Please specify the type of the topic')

        self.interval = interval or 25
        self.is_updating = False
        self.is_subscribed = False
        self.msg_key = create_id(self, 'last_msg')
        key = create_id(self, 'topic')
        
        topic = st.get(key, None)
        last_msg = st.get(self.msg_key, None)

        if ros_client and ros_client.is_connected:
            if start:
                if topic and topic.is_subscribed:
                    topic.unsubscribe()
                    time.sleep(0.2)
    
                topic = Topic(ros_client, topic_name, topic_type)
                topic.subscribe(self.topic_callback)
                st[key] = topic
                time.sleep(0.2)
            if stop and topic and topic.is_subscribed:
                topic.unsubscribe()
                time.sleep(0.2)

        self.is_subscribed = topic and topic.is_subscribed

        if last_msg:
            last_msg = ROSmsg.from_msg(last_msg)

        return (topic, last_msg, self.is_subscribed)

    def topic_callback(self, msg):
        st[self.msg_key] = msg

        if self.is_subscribed:
            ghdoc = ghenv.Component.OnPingDocument()
            if not self.is_updating and ghdoc.SolutionState != Grasshopper.Kernel.GH_ProcessStep.Process:
                self.is_updating = True
                ghdoc.ScheduleSolution(
                    self.interval, Grasshopper.Kernel.GH_Document.GH_ScheduleDelegate(self.expire_callback))

    def expire_callback(self, ghdoc):
        if ghdoc.SolutionState != Grasshopper.Kernel.GH_ProcessStep.Process:
            ghenv.Component.ExpireSolution(False)
        self.is_updating = False
# ---------- end subscribe ----------
irb910sc = GhPythonScript(load=Button())  # -> robot
# ---------- irb910sc: Python ----------
import os
from compas.robots import RobotModel
from compas.robots import LocalPackageMeshLoader
from compas_fab.robots import Robot
from compas_fab.robots import RobotSemantics
from compas_ghpython.artists import RobotModelArtist

HERE = os.path.dirname(ghenv.Component.OnPingDocument().FilePath)

models_path = os.path.join(HERE, '..', 'docker', 'irb910sc-planner')

urdf_file = os.path.join(models_path, 'abb_irb910sc_support', 'urdf', 'irb910sc_3_065.urdf')
srdf_file = os.path.join(models_path, 'abb_irb910sc_3_065_moveit_config', 'config', 'irb910.srdf')

model = RobotModel.from_urdf_file(urdf_file)
semantics = RobotSemantics.from_srdf_file(srdf_file, model)
loader = LocalPackageMeshLoader(models_path, 'abb_irb910sc_support')

model.load_geometry(loader)

robot = Robot(model, semantics=semantics)
robot.artist = RobotModelArtist(model)
robot.info()
# ---------- end irb910sc ----------
python = GhPythonScript(joint_state=subscribe.last_msg, robot=irb910sc)  # -> config
# ---------- python: Python ----------
import math
from compas.robots import Joint
from compas_fab.robots import Configuration

config = robot.zero_configuration()

for name, position in zip(joint_state.name, joint_state.position):
    joint = robot.get_joint_by_name(name)
    for i, jname in enumerate(config.joint_names):
        if jname == joint.name:
            config.values[i] = position
#    if joint.type in (Joint.CONTINUOUS, Joint.REVOLUTE):
#        position = math.radians(position)
#    if joint.type == Joint.PRISMATIC:
#        position = position / 1000
#    config[joint.name] = position

print config
# ---------- end python ----------
tool = GhPythonScript(robot=irb910sc, attach=Button(), detach=Button())  # -> robot
# ---------- tool: Python ----------
import os
from compas.datastructures import Mesh
from compas.geometry import Frame
from compas_fab.robots import Tool
from compas_ghpython.artists import RobotModelArtist

HERE = os.path.dirname(ghenv.Component.OnPingDocument().FilePath)

if robot:
    if attach:
        vmesh = Mesh.from_stl(os.path.join(HERE, 'vacuum-gripper-visual.stl'))
        cmesh = Mesh.from_stl(os.path.join(HERE, 'vacuum-gripper-collision.stl'))
        frame = Frame([0, 0, -0.04328], [0, 0, 1], [0, 1, 0])
        tool = Tool(visual=vmesh, frame_in_tool0_frame=frame, collision=cmesh)
        robot.attach_tool(tool)
    if detach:
        robot.detach_tool()
# ---------- end tool ----------
robot_visualize = RobotVisualize(robot=tool, configuration=python, show_visual=True)  # -> visual, collision, attached_meshes, frames, base_frame, ee_frame; inputs attached_collision_meshes: list, show_visual: Boolean, show_collision: Boolean, show_frames: Boolean, show_base_frame: Boolean, show_end_effector_frame: Boolean, show_acm: Boolean
#   port group: The planning group used for end-effector and base visualization.
#   port configuration: The robot's full configuration.
#   port attached_collision_meshes: A list of attached collision meshes.
#   port show_visual: Whether or not to show the robot's visual meshes.
#   port show_collision: Whether or not to show the robot's collision meshes.
#   port show_frames: Whether or not to show the robot's joint frames.
#   port show_base_frame: Whether or not to show the robot's base frame.
#   port show_end_effector_frame: Whether or not to show the robot's end-effector frame.
#   port show_acm: Whether or not to show the attached collision meshes (if any).
#   port visual: Whether or not to show the attached collision meshes (if any).
#   port collision: Whether or not to show the attached collision meshes (if any).
#   port attached_meshes: Whether or not to show the attached collision meshes (if any).
#   port frames: Whether or not to show the attached collision meshes (if any).
#   port base_frame: Whether or not to show the attached collision meshes (if any).
#   port ee_frame: Whether or not to show the attached collision meshes (if any).
# ---------- robot_visualize: Python ----------
"""
Visualizes the robot.

COMPAS FAB v0.18.0
"""
from compas.geometry import Frame
from compas.geometry import Transformation
from compas_ghpython.artists import MeshArtist
from ghpythonlib.componentbase import executingcomponent as component


class RobotVisualize(component):
    def RunScript(self, robot, group, configuration, attached_collision_meshes, show_visual, show_collision,
                  show_frames, show_base_frame, show_end_effector_frame, show_acm):

        visual = None
        collision = None
        attached_meshes = None
        frames = None
        base_frame = None
        ee_frame = None

        if robot:
            show_visual = show_visual or True
            configuration = configuration or robot.zero_configuration()

            robot.update(configuration, visual=show_visual, collision=show_collision)
            frames = robot.transformed_frames(configuration, group)

            if show_visual:
                visual = robot.artist.draw_visual()

            if show_collision:
                collision = robot.artist.draw_collision()

            if show_base_frame:
                base_frame = frames[0]

            if show_end_effector_frame:
                ee_frame = robot.forward_kinematics(configuration, group, options=dict(solver='model'))

            if not show_frames:
                frames = None

            if show_acm:
                attached_meshes = []
                for acm in attached_collision_meshes:
                    frame = robot.forward_kinematics(configuration, options=dict(solver='model', link_name=acm.link_name))
                    T = Transformation.from_frame_to_frame(Frame.worldXY(), frame)
                    mesh = acm.collision_mesh.mesh.transformed(T)
                    attached_meshes.append(MeshArtist(mesh).draw())

        return (visual, collision, attached_meshes, frames, base_frame, ee_frame)
# ---------- end robot_visualize ----------
