# Grasshopper definition 99_control.ghx (Grasshopper 1.0.7)

# ----
# ROS
connect = BooleanToggle(True)
load_robot = BooleanToggle(True)
ros_connect = GhPythonScript(connect=connect)  # -> ros_client
# ---------- ros_connect: Python ----------
import Grasshopper
import System
from ghpythonlib.componentbase import executingcomponent as component
from scriptcontext import sticky as st

from compas_fab.backends import RosClient
from compas_fab.ghpython.components import create_id


class ROSConnect(component):
    def SetUpParam(self, p, name, nickname, description):
        p.Name = name
        p.NickName = nickname
        p.Description = description
        p.Optional = True

    def RegisterInputParams(self, pManager):

        p = Grasshopper.Kernel.Parameters.Param_String()
        self.SetUpParam(p, "ip", "ip", "The ip address of ROS master. Defaults to 127.0.0.1")
        p.Access = Grasshopper.Kernel.GH_ParamAccess.item
        self.Params.Input.Add(p)

        p = Grasshopper.Kernel.Parameters.Param_Integer()
        self.SetUpParam(p, "port", "port", "The port of ROS master. Defaults to 9090.")
        p.Access = Grasshopper.Kernel.GH_ParamAccess.item
        self.Params.Input.Add(p)

        p = Grasshopper.Kernel.Parameters.Param_Boolean()
        self.SetUpParam(p, "connect", "connect", "If `True`, connect to ROS. If `False`, disconnect from ROS. Defaults to False.")
        p.Access = Grasshopper.Kernel.GH_ParamAccess.item
        self.Params.Input.Add(p)

    def RegisterOutputParams(self, pManager):
        p = Grasshopper.Kernel.Parameters.Param_GenericObject()
        self.SetUpParam(p, "ros_client", "ros_client", "The ROS client.")
        self.Params.Output.Add(p)

    def SolveInstance(self, DA):
        p0 = self.marshal.GetInput(DA, 0)
        p1 = self.marshal.GetInput(DA, 1)
        p2 = self.marshal.GetInput(DA, 2)
        result = self.RunScript(p0, p1, p2)

        if result is not None:
            self.marshal.SetOutput(result, DA, 0, True)

    def RunScript(self, ip, port, connect):
        ros_client = None

        ip = ip or '127.0.0.1'
        port = port or 9090

        key = create_id(self, 'ros_client')
        ros_client = st.get(key, None)

        if ros_client:
            st[key].close()
        if connect:
            st[key] = RosClient(ip, port)
            st[key].run(5)

        ros_client = st.get(key, None)
        self.Message = 'Connected' if ros_client and ros_client.is_connected else 'Not connected'
        return ros_client
# ---------- end ros_connect ----------
load_robot_2 = GhPythonScript(ros_client=ros_connect, load=load_robot)  # -> robot
# ---------- load_robot_2: Python ----------
import Grasshopper
import System
from ghpythonlib.componentbase import executingcomponent as component
from scriptcontext import sticky as st

import compas
from compas_fab.ghpython.components import create_id
from compas_fab.ghpython.components.icons import ros_robot_icon
from compas_ghpython.artists import RobotModelArtist


class ROSRobot(component):
    def SetUpParam(self, p, name, nickname, description):
        p.Name = name
        p.NickName = nickname
        p.Description = description
        p.Optional = True

    def RegisterInputParams(self, pManager):
        p = Grasshopper.Kernel.Parameters.Param_GenericObject()
        self.SetUpParam(p, "ros_client", "ros_client", "The ROS client.")
        p.Access = Grasshopper.Kernel.GH_ParamAccess.item
        self.Params.Input.Add(p)

        p = Grasshopper.Kernel.Parameters.Param_Boolean()
        self.SetUpParam(p, "load", "load", "If `True`, loads the robot from ROS. Defaults to False.")
        p.Access = Grasshopper.Kernel.GH_ParamAccess.item
        self.Params.Input.Add(p)

    def RegisterOutputParams(self, pManager):
        p = Grasshopper.Kernel.Parameters.Param_GenericObject()
        self.SetUpParam(p, "robot", "robot", "The robot.")
        self.Params.Output.Add(p)

    def SolveInstance(self, DA):
        p0 = self.marshal.GetInput(DA, 0)
        p1 = self.marshal.GetInput(DA, 1)
        result = self.RunScript(p0, p1)

        if result is not None:
            self.marshal.SetOutput(result, DA, 0, True)

    def get_Internal_Icon_24x24(self):
        return ros_robot_icon

    def RunScript(self, ros_client, load):
        self.Message = "Loading..."
        compas.PRECISION = '12f'

        key = create_id(self, 'robot')

        if ros_client and ros_client.is_connected and load:
            # Load URDF from ROS
            robot = ros_client.load_robot(load_geometry=True)
            robot.artist = RobotModelArtist(robot.model)
            self.Message = "{} loaded".format(robot.name)
            st[key] = robot
        else:
            if st.get(key):
                self.Message = "{} loaded".format(st.get(key).name)
            else:
                self.Message = "No robot"

        robot = st.get(key, None)
        if robot:  # client sometimes need to be restarted, without needing to reload geometry
            robot.client = ros_client
        return robot
# ---------- end load_robot_2 ----------

# ----
# Tool
attach = BooleanToggle(True)
z_offset = Slider(-0.043, range=-0.1..0.2)
attach_tool = GhPythonScript(robot=load_robot_2, attached=attach, z_offset=z_offset)  # -> tool_at_origin
# ---------- attach_tool: Python ----------
import os
from compas.geometry import Frame
from compas.datastructures import Mesh
from compas_fab.robots import PlanningScene
from compas_fab.robots import Tool
from compas_ghpython.artists import MeshArtist

HERE = os.path.dirname(ghenv.Component.OnPingDocument().FilePath)

# create tool from mesh and frame
vmesh = Mesh.from_stl(os.path.join(HERE, 'vacuum-gripper-visual.stl'))
cmesh = Mesh.from_stl(os.path.join(HERE, 'vacuum-gripper-collision.stl'))
frame = Frame([0, 0, z_offset], [1, 0, 0], [0, 1, 0])
tool = Tool(visual=vmesh, frame_in_tool0_frame=frame, collision=cmesh)

tool_at_origin = MeshArtist(vmesh).draw()

if robot and robot.client and robot.client.is_connected:
    scene = PlanningScene(robot)
    if attached:
        robot.attach_tool(tool, touch_links=['flange', 'link4', 'link3'])
        scene.add_attached_tool()
    else:
        if robot.attached_tool:
            scene.remove_attached_tool()
            scene.remove_collision_mesh('attached_tool_link_collision_0')
            robot.detach_tool()
# ---------- end attach_tool ----------

# ----
# Static objects
mesh = Mesh(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)
mesh_2 = Mesh(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)
python = GhPythonScript(robot=load_robot_2, meshes=[mesh, mesh_2])  # inputs meshes: list
# ---------- python: Python ----------
import os
from compas.geometry import Frame
from compas.datastructures import Mesh
from compas_fab.robots import PlanningScene
from compas_fab.robots import CollisionMesh
from compas_ghpython.artists import MeshArtist
from compas_rhino.geometry import RhinoMesh

if robot and robot.client and robot.client.is_connected:
    static_cm_name = 'static_objects'
    scene = PlanningScene(robot)
    scene.remove_collision_mesh(static_cm_name)
    if meshes:
        for mesh in meshes:
            mesh = RhinoMesh.from_geometry(mesh).to_compas()
            cm = CollisionMesh(mesh, static_cm_name)
            scene.append_collision_mesh(cm)
# ---------- end python ----------

# ----
# Pick
pt = Point(Point(0.3, 0.52, 0.0323))
python_2 = GhPythonScript(robot=load_robot_2, pick_at_tcf=pt)  # -> pick_at_t0cf, pick_at_tcf
# ---------- python_2: Python ----------
import rhinoscriptsyntax as sc
from compas.geometry import Frame

frame = Frame.worldXY()
pick_at_tcf = sc.coerce3dpoint(pick_at_tcf)
frame.point = [pick_at_tcf.X, pick_at_tcf.Y, pick_at_tcf.Z]
pick_at_tcf = frame
pick_at_t0cf = robot.from_tcf_to_t0cf([pick_at_tcf])[0]
# ---------- end python_2 ----------

python_3 = GhPythonScript(robot=load_robot_2)  # -> plane_at_t0cf
# ---------- python_3: Python ----------
from compas_fab.ghpython.components import coerce_frame
if plane:
    plane = coerce_frame(plane)
    plane_at_t0cf = robot.from_tcf_to_t0cf([plane])[0]
# ---------- end python_3 ----------
python_4 = GhPythonScript(filename="assembly.json", load=Toggle(True))  # -> assembly
# ---------- python_4: Python ----------
import os
import sys

HERE = os.path.dirname(ghenv.Component.OnPingDocument().FilePath)
if HERE not in sys.path: sys.path.append(HERE)

import compas

assembly = compas.json_load(os.path.join(HERE, filename))
# ---------- end python_4 ----------
number_slider = Slider(1, range=1..100)
transform = GhPythonScript()  # -> T
# ---------- transform: Python ----------
from compas.geometry import Rotation
from compas.geometry import Translation

T = Translation.from_vector([0, 0, .02]) * Rotation.from_axis_and_angle([0, 0, 1], 3.14/2)
# ---------- end transform ----------
python_5 = GhPythonScript(assembly=python_4, T=transform)  # -> elements, frames
# ---------- python_5: Python ----------
from compas_fab.robots import JointTrajectory
from compas_ghpython.artists import MeshArtist
#from helpers import traversal_buildup_sequence
#from helpers import traversal_breadth_first_ordering
from helpers import traversal_linearly_ordered
from compas_ghpython.artists import FrameArtist

elements = []
frames = []

for j, n in enumerate(traversal_linearly_ordered(assembly)):
    geom = assembly.element(n).geometry_at_placement
    geom = geom.transformed(T)
    mesh = MeshArtist(geom).draw()
    elements.append(mesh)

    fa = FrameArtist(assembly.element(n).frame.transformed(T), scale=.02)
    a, b = fa.draw()
    frames.extend(a)
    frames.extend(b)
# ---------- end python_5 ----------
ik = InverseKinematics(robot=load_robot_2, plane=python_3)  # -> configuration
#   port plane: The plane or frame to calculate the inverse kinematic for.
#   port start_configuration: If passed, calculates the inverse such that the joint positions differ the least from the start_configuration. Defaults to the zero configuration.
#   port group: The planning group used for calculation. Defaults to the robot's main planning group.
#   port configuration: The planning group's configuration.
# ---------- ik: Python ----------
"""
Calculate the robot's inverse kinematic for a given plane.

COMPAS FAB v0.18.0
"""
from ghpythonlib.componentbase import executingcomponent as component

from compas_fab.ghpython.components import coerce_frame


class InverseKinematics(component):
    def RunScript(self, robot, plane, start_configuration, group):
        configuration = None
        if robot and robot.client and robot.client.is_connected and plane:
            frame = coerce_frame(plane)
            configuration = robot.inverse_kinematics(frame, start_configuration, group)
        return configuration
# ---------- end ik ----------
split = SplitList(List=python_5.elements, Index=number_slider)  # -> ListA, ListB

# ----
# Execute
toggle = BooleanToggle(False)
ros = ROSConnect(ip="ros-vzby-dzht.yaler.io", port=80, connect=toggle)  # -> ros_client, is_connected; inputs port: Int32, connect: Boolean
#   port ip: The ip address ROS. Defaults to 127.0.0.1.
#   port port: The port of ROS. Defaults to 9090.
#   port connect: If True, connects to ROS. If False, disconnects from ROS. Defaults to False.
#   port ros_client: The ROS client.
#   port is_connected: True if connection established.
# ---------- ros: Python ----------
"""
Connect or disconnect to ROS.

COMPAS FAB v0.18.0
"""
from ghpythonlib.componentbase import executingcomponent as component
from scriptcontext import sticky as st

from compas_fab.backends import RosClient
from compas_fab.ghpython.components import create_id


class ROSConnect(component):
    def RunScript(self, ip, port, connect):
        ros_client = None

        ip = ip or '127.0.0.1'
        port = port or 9090

        key = create_id(self, 'ros_client')
        ros_client = st.get(key, None)

        if ros_client:
            st[key].close()
        if connect:
            st[key] = RosClient(ip, port)
            st[key].run(5)

        ros_client = st.get(key, None)
        is_connected = ros_client.is_connected if ros_client else False
        return (ros_client, is_connected)
# ---------- end ros ----------
place = GhPythonScript(
    robot=load_robot_2,
    ros_client=ros.ros_client,
    assembly=python_4,
    pick_tcf=python_2.pick_at_tcf,
    T=transform,
    n=number_slider,
    check=Button(),
    execute=Button())  # -> configs
# ---------- place: Python ----------
from compas.geometry import Translation
from compas.geometry import Scale
from compas_fab.ghpython.components import coerce_frame
from compas_fab.ghpython.components import create_id

from scriptcontext import sticky as st
import compas_rrc as rrc

key = create_id(ghenv.Component, 'configs')

i = n - 1
element = assembly.element(i)
element_frame = element.frame.transformed(T)

height = 0.012
safety_offset = 0.001
place_frame = element_frame.transformed(Translation.from_vector([0, 0, (height / 2.) + safety_offset]))

approach_offset = 0.060  # 60mm
t_approach = Translation.from_vector([0, 0, approach_offset])
pick_frame = pick_tcf
approach_pick_frame = pick_frame.transformed(t_approach)
approach_place_frame = place_frame.transformed(t_approach)

if check:
    planes = [approach_pick_frame, pick_frame, approach_place_frame, place_frame]
    planes_at_t0cf = robot.from_tcf_to_t0cf(planes)
    configs = []
    for frame in planes_at_t0cf:
        configs.append(robot.inverse_kinematics(frame))
    
    st[key] = configs

configs = st.get(key)

#a = []
#a.append(rg.Plane(rg.Point3d(*list(pick_frame.point)), rg.Vector3d(*list(pick_frame.xaxis)), rg.Vector3d(*list(pick_frame.yaxis))))
#a.append(rg.Plane(rg.Point3d(*list(approach_pick_frame.point)), rg.Vector3d(*list(approach_pick_frame.xaxis)), rg.Vector3d(*list(approach_pick_frame.yaxis))))
#a.append(rg.Plane(rg.Point3d(*list(approach_place_frame.point)), rg.Vector3d(*list(approach_place_frame.xaxis)), rg.Vector3d(*list(approach_place_frame.yaxis))))
#a.append(rg.Plane(rg.Point3d(*list(place_frame.point)), rg.Vector3d(*list(place_frame.xaxis)), rg.Vector3d(*list(place_frame.yaxis))))

print ('Pick at {}, {}, {}'.format(*list(pick_frame.point)))
print ('Place at {}, {}, {}'.format(*list(place_frame.point)))


# Convert to RRC
S = Scale.from_factors([1000, 1000, 1000])
pick_frame = pick_frame.transformed(S)
place_frame = place_frame.transformed(S)
approach_pick_frame = approach_pick_frame.transformed(S)
approach_place_frame = approach_place_frame.transformed(S)


if execute:
    # Create ABB Client
    abb = rrc.AbbClient(ros_client, '/rob1')

    # Reset signals
    abb.send(rrc.SetDigital('doUnitC106Out2',0))

    # Set tool
    abb.send(rrc.SetTool('t_RRC_Vacuum_Gripper'))

    # Set work object
    abb.send(rrc.SetWorkObject('wobj0'))

    # Define speed
    speed = 100

    # Move over pick position
    abb.send(rrc.MoveToFrame(approach_pick_frame, speed, rrc.Zone.Z10))

    # Move to pick position
    abb.send(rrc.MoveToFrame(pick_frame, speed, rrc.Zone.FINE))

    # Vacuum on
    abb.send(rrc.SetDigital('doUnitC106Out2',1))

    # Move over pick position
    abb.send(rrc.MoveToFrame(approach_pick_frame, speed, rrc.Zone.Z10))

    # Move over place position
    abb.send(rrc.MoveToFrame(approach_place_frame, speed, rrc.Zone.Z10))

    # Move to place position
    abb.send_and_wait(rrc.MoveToFrame(place_frame, speed, rrc.Zone.FINE))

    # Vacuum off
    abb.send_and_wait(rrc.SetDigital('doUnitC106Out2',0))

    # Move over place position
    abb.send(rrc.MoveToFrame(approach_place_frame, speed, rrc.Zone.Z10))
# ---------- end place ----------
item = ListItem(List=place, Index=Slider(0, range=0..10), Wrap=True)

mesh_3 = Mesh(split.ListA)
ros_2 = ROSConnect()  # -> ros_client, is_connected; inputs port: Int32, connect: Boolean; same code as ros

# ----
# Visualization
reload = BooleanToggle(True)
visualize = GhPythonScript(robot=load_robot_2, configuration=item, reload_scene=reload)  # -> visual, frames, attached_collision_meshes, collision_meshes
# ---------- visualize: Python ----------
import Grasshopper
import System
from ghpythonlib.componentbase import executingcomponent as component
from scriptcontext import sticky as st

from compas.geometry import Frame
from compas.geometry import Transformation
from compas_ghpython.artists import MeshArtist
from compas_ghpython import draw_frame
from compas_fab.ghpython.components import create_id
from compas_fab.ghpython.components.icons import robot_visualize_icon

class RobotVisualize(component):
    def SetUpParam(self, p, name, nickname, description):
        p.Name = name
        p.NickName = nickname
        p.Description = description
        p.Optional = True

    def get_Internal_Icon_24x24(self):
        return robot_visualize_icon

    def RunScript(self, robot, group, configuration, reload_scene):

        visual = None
        frames = None
        collision_meshes = []
        attached_collision_meshes = []

        if robot:
            configuration = configuration or robot.zero_configuration()

            robot.update(configuration, visual=True, collision=False)
            frames = [draw_frame(f) for f in robot.transformed_frames(configuration, group)]

            visual = robot.artist.draw_visual()
            
        scene_key = create_id(self, 'scene')

        if robot and (reload_scene or scene_key not in st):
            st[scene_key] = robot.client.get_planning_scene()
        
        scene = st.get(scene_key, None)

        if scene:
            scene_key_co = scene_key + '_co'
            if reload_scene or scene_key_co not in st:
                for co in scene.world.collision_objects:
                    # HACK: Little workaround to a bug in to_collision_meshes()
                    header = co.header
                    frame_id = header.frame_id
                    co.header = dict(frame_id=frame_id)
                    cms = co.to_collision_meshes()
                    # HACK: Restore proper header
                    co.header = header
                
                    for cm in cms:
                        if frame_id != '/base_link':
                            raise Exception('Only world-referenced collision meshes are supported')
                
                        if cm.frame != Frame.worldXY():
                            t = Transformation.from_frame(cm.frame)
                            mesh = cm.mesh.transformed(t)
                        else:
                            mesh = cm.mesh
                
                        rhino_mesh = MeshArtist(mesh).draw()
                        collision_meshes.append(rhino_mesh)
                st[scene_key_co] = collision_meshes

            collision_meshes = st.get(scene_key_co, None)
            
            for aco in scene.robot_state.attached_collision_objects:
                for acm in aco.to_attached_collision_meshes():
                    frame_id = aco.object['header']['frame_id']
                    frame = robot.forward_kinematics(configuration, options=dict(link=frame_id))
                    t = Transformation.from_frame(frame)

                    # Local CM frame
                    if acm.collision_mesh.frame and acm.collision_mesh.frame != Frame.worldXY():
                        t = t * Transformation.from_frame(acm.collision_mesh.frame)

                    mesh = acm.collision_mesh.mesh.transformed(t)
            
                    rhino_mesh = MeshArtist(mesh).draw()
                    attached_collision_meshes.append(rhino_mesh)

        return (visual, frames, attached_collision_meshes, collision_meshes)
# ---------- end visualize ----------
