# Grasshopper definition scalar_field_slicing_AL.gh (Grasshopper 1.0.7)
# plug-ins: Pufferfish

# ---- group: FOLDER
data_folder_name = Panel("data")

# ----
panel = Panel("data\ for windows")
vase = Mesh(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)

# ----
# Output
# Inputs
py = PythonScript()  # -> path
# ---------- py: Python ----------
import sys
import os

ghComp = ghenv.Component
ghDoc = ghComp.OnPingDocument()


# the full path of the gh file
path = ghDoc.FilePath
# the current directory 
path = os.path.abspath(os.path.join(path, ".."))

print path

# HERE = os.path.dirname(ghenv.Component.OnPingDocument().FilePath)
# if HERE not in sys.path: sys.path.append(HERE)
# ---------- end py ----------

# ---- group: Folder name
data = Data(data_folder_name)

# ---- group: Input mesh
mesh = Mesh(vase)

# ---- group: Path cross-section
# Visualization
xz = XZPlane(Origin=Point(0, 0, 0))
rectangle = Rectangle(Plane=xz, XSize=Slider(2.5, range=0..10), YSize=Slider(1, range=0..10), Radius=Slider(0.43, range=0..1))  # -> Rectangle, Length

# ----
# Load Printpoints
panel_2 = Panel("out_printpoints.json")
csloadprintpoints = CsLoadPrintpoints(recompute=Button(), json_name=panel_2, path=py, folder_name=data)  # -> out, geometry, points, frames, layer_heights, up_vectors, mesh_normals, closest_support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; inputs recompute: Boolean
# ---------- csloadprintpoints: Python ----------
"""
Loads a dictionaly of Printpoints from a json file in the 'output' folder.

"""

import compas_slicer_ghpython.visualization as gh_compas_slicer
gh_compas_slicer = reload(gh_compas_slicer)


if path and folder_name and json_name:
    points, frames, layer_heights, up_vectors, mesh_normals, closest_support, velocities, wait_times, \
    blend_radiuses, extruder_toggles = \
        gh_compas_slicer.load_printpoints(path, folder_name, json_name)
    
else:
    gh_compas_slicer.missing_input()
# ---------- end csloadprintpoints ----------

# ----
# Load Slicer
panel_3 = Panel("isocontours.json")
csloadslicer = CsLoadSlicer(recompute=Button(), json_name=panel_3, path=py, folder_name=data)  # -> out, mesh, paths, are_closed, all_points; inputs recompute: Boolean
# ---------- csloadslicer: Python ----------
"""
Loads a Slicer class from its json file in the 'output' folder.

"""

import compas_slicer_ghpython.visualization as gh_compas_slicer
gh_compas_slicer = reload(gh_compas_slicer)


if path and folder_name and json_name:
    mesh, paths, are_closed, all_points = gh_compas_slicer.load_slicer(path, folder_name, json_name)
    
else:
    gh_compas_slicer.missing_input()
# ---------- end csloadslicer ----------

panel_4 = Panel(csloadslicer.out)
panel_5 = Panel(csloadprintpoints.out)

mesh_2 = Mesh(csloadslicer.mesh)
paths = Curve(csloadslicer.paths)
all_points = Point(csloadslicer.all_points)

points = Point(csloadprintpoints.points)
frames = Plane(csloadprintpoints.frames)
cpts = Point(csloadprintpoints.closest_support)
layer_heights = Number(csloadprintpoints.layer_heights)
up_vectors = Vector(csloadprintpoints.up_vectors)
mesh_normals = Vector(csloadprintpoints.mesh_normals)

frames_2 = Plane(frames)
flippln = FlipPlane(Plane=frames_2, FlipX=False, FlipY=False, FlipZ=True)  # -> Flipped, R

print_planes = Plane(flippln.Flipped)
tool_mesh = Mesh(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)

# ----
# Tool Visualization
# Note: This is only an example. The actual tool orientation depends on the definition of the frame of your tool
number_slider = Slider(1104, range=0..2000)
tool_origin = Panel("""0
0
99.507""")
cstoolviz = CsToolViz(origin_coords=tool_origin, mesh=tool_mesh, planes=print_planes, index=number_slider)  # -> out, mesh, passed_path; inputs origin_coords: list, mesh: Mesh, planes: list, index: Int32
# ---------- cstoolviz: Python ----------
"""
Example visualization of tool motion during the print.

"""

import compas_slicer_ghpython.visualization as gh_compas_slicer
gh_compas_slicer = reload(gh_compas_slicer)

if origin_coords and mesh and planes and (index or index==0):
    mesh, passed_path = gh_compas_slicer.tool_visualization(origin_coords, mesh, planes, index)
else:
    gh_compas_slicer.missing_input()
# ---------- end cstoolviz ----------

mesh_normals_2 = Vector(mesh_normals)
points_2 = Point(points)
section = Curve(rectangle.Rectangle)

velocities = Number(csloadprintpoints.velocities)
wait_times = Number(csloadprintpoints.wait_times)
blend_radiuses = Number(csloadprintpoints.blend_radiuses)
extruder_toggles = Number(csloadprintpoints.extruder_toggles)

# ----
# Ligthweight Path Visualization
number_slider_2 = Slider(3.9, range=0..10)
extruder_toggles_2 = Number(extruder_toggles)
all_points_2 = Point(points)
cslightpathviz = CsLightPathViz(
    points=all_points_2,
    extruder_toggles=extruder_toggles_2,
    domain_start=Slider(0, range=0..100),
    domain_end=Slider(1263, range=0..2000),
    pipe_diameter=number_slider_2)  # -> out, print_path_pipes, travel_path_lines; inputs points: list of Point3d, extruder_toggles: list of Boolean, domain_start: Int32, domain_end: Int32
# ---------- cslightpathviz: Python ----------
"""
Creates a lightweight visualization of the print paths. Segments with extruder_toggle=True are visualized as pipes, 
segments with extruder_toggle=False are visualized as lines.
Loads files from the 'output' folder.

"""

import compas_slicer_ghpython.visualization as gh_compas_slicer
gh_compas_slicer = reload(gh_compas_slicer)

pipe_resolution = 14

if points:
    
    # assign default values to parameters where possible. 
    if not extruder_toggles:
        extruder_toggles = [False for i in range(len(points))]
    if not domain_start:
        domain_start = 0
    if not domain_end:
        domain_end = len(points)
    if not pipe_diameter:
        pipe_diameter = 2.0
        
    print_path_pipes, travel_path_lines = \
        gh_compas_slicer.lightweight_path_visualization(points, extruder_toggles, domain_start, domain_end, pipe_diameter, pipe_resolution)
    
else:
    gh_compas_slicer.missing_input()
# ---------- end cslightpathviz ----------

# ----
# Render Path Visualization
toggle = BooleanToggle(False)
extruder_toggles_3 = Number(extruder_toggles)
layer_heights_2 = Number(layer_heights)
up_vectors_2 = Vector(up_vectors)

python = CsRenderPathViz(
    points=points_2,
    mesh_normals=mesh_normals_2,
    layer_heights=layer_heights_2,
    up_vectors=up_vectors_2,
    extruder_toggles=extruder_toggles_3,
    cross_section=section,
    planar_printing=toggle,
    compute=Toggle(True))  # -> out, loft_surfaces, travel_path_lines; inputs points: list of Point3d, mesh_normals: list of Vector3d, layer_heights: list, up_vectors: list of Vector3d, extruder_toggles: list of Boolean, cross_section: Curve, planar_printing: Boolean, compute: Boolean
# ---------- python: Python ----------
"""
Creates a render visualization of the print paths with loft surfaces where extruder_toggle=True.
For large number of points, this can take a while to compute, so keep it turned off unless you need it.
Loads files from the 'output' folder.

"""

import compas_slicer_ghpython.visualization as gh_compas_slicer
gh_compas_slicer = reload(gh_compas_slicer)

pipe_resolution = 14

if points and mesh_normals and layer_heights and extruder_toggles and cross_section:
    if compute:
        loft_surfaces, travel_path_lines = \
            gh_compas_slicer.render_path_visualization(points, mesh_normals, layer_heights, up_vectors, extruder_toggles, cross_section, planar_printing)
    else:
        print('Compute is set to False')
else:
    gh_compas_slicer.missing_input()
# ---------- end python ----------
ln = Line(StartPoint=points, EndPoint=cpts)
vdis = VectorDisplay(Anchor=points, Vector=expr("x*5", up_vectors))

# ---- group: Color output
geo = Geometry(cslightpathviz.travel_path_lines)
geo_2 = Geometry(cslightpathviz.print_path_pipes)
preview = CustomPreview(Geometry=geo_2, Material=ColourSwatch(SwatchColor=RGB(199, 199, 199)))
preview_2 = CustomPreview(Geometry=geo, Material=ColourSwatch(SwatchColor=RGB(255, 156, 36)))

geo_3 = Geometry(python.loft_surfaces)
geo_4 = Geometry(python.travel_path_lines)
preview_3 = CustomPreview(Geometry=geo_3, Material=ColourSwatch(SwatchColor=RGB(222, 222, 222)))
preview_4 = CustomPreview(Geometry=geo_4, Material=ColourSwatch(SwatchColor=RGB(255, 156, 36)))

# ----
mesh_3 = Mesh(cstoolviz.mesh)
geo_5 = Geometry(cstoolviz.passed_path)
preview_5 = CustomPreview(Geometry=mesh_3, Material=ColourSwatch(SwatchColor=RGB(171, 171, 171)))
preview_6 = CustomPreview(Geometry=geo_5, Material=ColourSwatch(SwatchColor=RGB(255, 156, 36)))

pline = PolyLine(Vertices=points, Closed=False)

# ---- group: Select parameter
num = Number(blend_radiuses)

# ---- group: Visualize parameter with text
tag_offset = Slider(1, range=0..100)
pdecon = Deconstruct(Point=points)  # -> XComponent, YComponent, ZComponent
addition = Addition(A=pdecon.ZComponent, B=tag_offset)
pt = ConstructPoint(XCoordinate=pdecon.XComponent, YCoordinate=pdecon.YComponent, ZCoordinate=addition)
tag = TextTag(Location=pt, Text=num, Colour=ColourSwatch(SwatchColor=RGB(50, 130, 186)))

# ---- group: Visualize parameter with color
bnd = Bounds(Numbers=num)
avr = Average(Input=num)
dedomain = DeconstructDomain(Domain=bnd)  # -> Start, End
average = Panel(avr)
gradient = Gradient(
    LowerLimit=dedomain.Start,
    UpperLimit=dedomain.End,
    Parameter=num,
    stops=[0: RGB(0, 128, 0), 0.5: RGB(255, 255, 0), 1: RGB(255, 0, 0)])
pt_2 = Point(points)
cloud = CloudDisplay(Points=pt_2, Colours=gradient, Size=Slider(3.96, range=0..10), SpriteType=0)

# ---- group: Slicer data
len = Length(Curve=flatten(paths))
lng = ListLength(List=flatten(paths))
sum = GhPythonScript(x=len)  # -> out, a; inputs x: list
# ---------- sum: Python ----------
__author__ = "Ioanna"
__version__ = "2020.10.25"

import rhinoscriptsyntax as rs

a = 0
for v in x:
    a += v
# ---------- end sum ----------
total_path_length = Panel(sum.a)
total_number_of_paths = Panel(lng)

# ----
min = Panel(dedomain.Start)
max = Panel(dedomain.End)
